# Grasshopper definition corso_gh.gh (Grasshopper 1.0.7)

# ----
# ctrl per eliminare cavo
# shift per aggiungerlo
# 
# ACTUNG
# 
# Usare merge per essere sicuri dell'ordine di ingresso
number_slider = Slider(2.62, range=-10..10)
merge = Merge(Data1=number_slider, Data2=Slider(-2.05, range=-10..10))
pt = ConstructPoint(XCoordinate=merge, YCoordinate=Slider(2.89, range=-3..10), ZCoordinate=Slider(3.47, range=2..5))

# ----
# Io sono un panel
number_slider_2 = Slider(2.89, range=-3..10)
# La mia descrizione
panel = Panel("Il mio testo")
pt_2 = ConstructPoint(XCoordinate=Slider(0.51, range=-3..10), YCoordinate=number_slider_2, ZCoordinate=Slider(2.48, range=2..5))
pt_3 = ConstructPoint(XCoordinate=Slider(-1.92, range=-3..10), YCoordinate=Slider(4.28, range=-3..10), ZCoordinate=Slider(2, range=2..5))
ln = Line(StartPoint=pt_2, EndPoint=pt_3)

sph = Sphere(Base=PlaneXY(0, 0, 0), Radius=1)
pt_4 = ConstructPoint(XCoordinate=Slider(2.89, range=-3..10), YCoordinate=Slider(2.89, range=-3..10), ZCoordinate=Slider(3.47, range=2..5))
pt_5 = ConstructPoint(XCoordinate=Slider(-1.92, range=-3..10), YCoordinate=Slider(10, range=-3..10), ZCoordinate=Slider(2, range=2..5))
my_base_column_points = Point([<point referenced from the Rhino model> x11])
my_base_column_points_2 = Point([<point referenced from the Rhino model> x11])
geo = Geometry(Point(17.25139846, 5.594544623, 0))
pt_6 = Point(<point referenced from the Rhino model>)
graft = GraftTree(Tree=my_base_column_points, IncludeEmptyLists=True, IncludeNullItems=True)
ln_2 = Line(StartPoint=pt_4, EndPoint=pt_5)
data = Data(my_base_column_points_2)
data_2 = Data(pt_6)
ln_3 = Line(StartPoint=ln_2)
data_3 = Data(graft)

# ----
# Io sono un panel
number_slider_3 = Slider(2.89, range=-3..10)
# La mia descrizione
panel_2 = Panel("Il mio testo")
pt_7 = ConstructPoint(XCoordinate=Slider(0.51, range=-3..10), YCoordinate=number_slider_3, ZCoordinate=Slider(2.48, range=2..5))
pt_8 = ConstructPoint(XCoordinate=Slider(-1.92, range=-3..10), YCoordinate=Slider(4.28, range=-3..10), ZCoordinate=Slider(2, range=2..5))
ln_4 = Line(StartPoint=pt_7, EndPoint=pt_8)

data_4 = Data(ln_4)
data_5 = Data(graft)
data_6 = Data(graft)
data_7 = Data(graft)
