# Grasshopper definition draw triangle.gh (Grasshopper 1.0.7)

# ----
# Input
number_slider = Slider(5, range=3..10)
number_slider_2 = Slider(3, range=0..10)
C = ConstructPoint(XCoordinate=number_slider_2, YCoordinate=number_slider, ZCoordinate=0)
base = Panel("7")
altezza = Panel("5")

# ----
# Input
number_slider_3 = Slider(8, range=0..10)
C_2 = ConstructPoint(XCoordinate=number_slider_3, YCoordinate=Slider(5, range=3..10), ZCoordinate=0)
base_2 = Panel("7")
altezza_2 = Panel("12")

circle_cnr = CircleCNR(Center="0,0,0", Normal=Vector(0, 0, 1), Radius="1")
panel = Panel("3 points first")
area = Area(Geometry=circle_cnr)  # -> Area, Centroid
unit_x = UnitX(Factor=1)

addition = Addition(A=number_slider, B=altezza)
B = ConstructPoint(XCoordinate=Slider(3, range=0..10), YCoordinate=addition, ZCoordinate=0)
addition_2 = Addition(A=number_slider_2, B=base)
B_2 = ConstructPoint(XCoordinate=addition_2, YCoordinate=Slider(5, range=3..10), ZCoordinate=0)
merge = Merge(Data1=B, Data2=C, Data3=B_2)
polyline = PolyLine(Vertices=merge, Closed=Toggle(True))

unit_y = UnitY(Factor=1)
line_sdl = LineSDL(Start=C_2, Direction=unit_x, Length=base_2)
line_sdl_2 = LineSDL(Start=C_2, Direction=unit_y, Length=altezza_2)
end_points = EndPoints(Curve=line_sdl)  # -> Start, End
end_points_2 = EndPoints(Curve=line_sdl_2)  # -> Start, End
line = Line(StartPoint=end_points_2.End, EndPoint=end_points.End)
merge_2 = Merge(Data1=line_sdl_2, Data2=line, Data3=line_sdl)

# ----
# Output
curve = Curve(polyline)

join_curves = JoinCurves(Curves=merge_2, Preserve=False)
area_2 = Area(Geometry=join_curves)  # -> Area, Centroid
panel_2 = Panel(join_curves)
line_2 = Line(StartPoint=area_2.Centroid, EndPoint=area.Centroid)
