# Grasshopper definition exercise.gh (Grasshopper 1.0.7)

# ----
# select only lines within a region
rectangle = Curve(<curve referenced from the Rhino model>)
columns = Curve([<curve referenced from the Rhino model> x11])
line_sdl = LineSDL(Start="0,0,0", Direction=Vector(0, 0, 1), Length=1)
flip_curve = FlipCurve(Curve=columns, Guide=line_sdl)  # -> Curve, Flag
evaluate_length = EvaluateLength(Curve=flip_curve.Curve, Length="0", Normalized=invert(True))  # -> Point, Tangent, Parameter
surface_closest_point = SurfaceClosestPoint(Point=evaluate_length.Point, Surface=rectangle)  # -> Point, UVPoint, Distance
line = Line(StartPoint=evaluate_length.Point, EndPoint=surface_closest_point.Point)
smaller_than = SmallerThan(FirstNumber=surface_closest_point.Distance, SecondNumber="0.0001")  # -> SmallerThan, OrEqualTo
cull_pattern = CullPattern(List=flip_curve.Curve, CullPattern=smaller_than.SmallerThan)

# ----
# select only point at the base of list curves
curve = Curve([<curve referenced from the Rhino model> x77])
end_points = EndPoints(Curve=curve)  # -> Start, End
point = Point([end_points.Start, end_points.End])

deconstruct = Deconstruct(Point=point)  # -> XComponent, YComponent, ZComponent
bounds = Bounds(Numbers=deconstruct.ZComponent)
deconstruct_domain = DeconstructDomain(Domain=bounds)  # -> Start, End
panel = Panel(deconstruct_domain.Start)
addition = Addition(A=panel, B="0.00001")
smaller_than_2 = SmallerThan(FirstNumber=deconstruct.ZComponent, SecondNumber=addition)  # -> SmallerThan, OrEqualTo

surface = Surface([<surface referenced from the Rhino model> x4])
md_slider = MDSlider(
    SliderMode=0,
    slider_value=Point(0.5112886429, 0.4435539246, 0.5),
    x_domain=Domain(0, 1),
    y_domain=Domain(0, 1),
    z_domain=Domain(0, 1))
panel_2 = Panel(md_slider)
# script to select horizontal surfaces
evaluate_surface = EvaluateSurface(Surface=reparameterize(surface), Point=md_slider)  # -> Point, Normal, UDirection, VDirection, Frame
unit_z = UnitZ(Factor=1)
dot_product = DotProduct(VectorA=evaluate_surface.Normal, VectorB=unit_z, Unitize=False)
equality = Equality(FirstNumber=dot_product, SecondNumber="1")  # -> Equality, Inequality
cull_pattern_2 = CullPattern(List=surface, CullPattern=equality.Equality)

dispatch = Dispatch(List=point, DispatchPattern=smaller_than_2.SmallerThan)  # -> ListA, ListB
cull_pattern_3 = CullPattern(List=point, CullPattern=smaller_than_2.SmallerThan)
custom_preview = CustomPreview(Geometry=dispatch.ListB, Material=ColourSwatch(SwatchColor=RGB(255, 0, 0)))
custom_preview_2 = CustomPreview(Geometry=dispatch.ListA, Material=ColourSwatch(SwatchColor=RGB(0, 53, 245)))
panel_3 = Panel(cull_pattern_3)
populate_3d = Populate3D(Region={Plane=PlaneXY(0, 0, 0), X=Domain(0, 10), Y=Domain(0, 10), Z=Domain(0, 2)}, Count=100, Seed=1)
list_length = ListLength(List=populate_3d)
division = Division(A=list_length, B=2)
panel_4 = Panel(division)
panel_5 = Panel("4")
list_item = ListItem(Index=division, Wrap=True)
