# Grasshopper definition list.gh (Grasshopper 1.0.7)
# plug-ins: MeshEdit Components

number_slider = Slider(14, range=3..20)
curve = Curve(<curve referenced from the Rhino model>)
curve_2 = Curve(<curve referenced from the Rhino model>)
divide_curve = DivideCurve(Curve=curve, Count=number_slider, Kinks=False)  # -> Points, Tangents, Parameters
divide_curve_2 = DivideCurve(Curve=curve_2, Count=number_slider, Kinks=False)  # -> Points, Tangents, Parameters
line = Line(StartPoint=divide_curve.Points, EndPoint=divide_curve_2.Points)
panel = Panel(line)
list_item = ListItem(List=line, Index="5", Wrap=True)

number_slider_2 = Slider(14, range=3..20)
curve_3 = Curve(<curve referenced from the Rhino model>)
curve_4 = Curve(<curve referenced from the Rhino model>)
divide_curve_3 = DivideCurve(Curve=curve_3, Count=number_slider_2, Kinks=False)  # -> Points, Tangents, Parameters
divide_curve_4 = DivideCurve(Curve=curve_4, Count=number_slider_2, Kinks=False)  # -> Points, Tangents, Parameters
panel_2 = Panel("""8
9""")
list_item_2 = ListItem(List=divide_curve_3.Points, Index=panel_2, Wrap=True)
list_item_3 = ListItem(List=divide_curve_4.Points, Index=panel_2, Wrap=True)
panel_3 = Panel(list_item_2)
line_2 = Line(StartPoint=list_item_2, EndPoint=list_item_3)

number_slider_3 = Slider(14, range=3..20)
curve_5 = Curve(<curve referenced from the Rhino model>)
curve_6 = Curve(<curve referenced from the Rhino model>)
divide_curve_5 = DivideCurve(Curve=curve_5, Count=number_slider_3, Kinks=False)  # -> Points, Tangents, Parameters
divide_curve_6 = DivideCurve(Curve=curve_6, Count=number_slider_3, Kinks=False)  # -> Points, Tangents, Parameters
point_list = PointList(Points=divide_curve_6.Points, Size="2")
point_list_2 = PointList(Points=divide_curve_5.Points, Size="2")
list_item_4 = ListItem(List=divide_curve_5.Points, Index="4", Wrap=True)
list_item_5 = ListItem(List=divide_curve_6.Points, Index="8", Wrap=True)
list_item_6 = ListItem(List=divide_curve_6.Points, Index=0, Wrap=True)  # -> Item1, Item
line_3 = Line(StartPoint=list_item_4, EndPoint=list_item_5)

number_slider_4 = Slider(14, range=3..20)
number_slider_5 = Slider(14, range=3..20)
curve_7 = Curve(<curve referenced from the Rhino model>)
curve_8 = Curve(<curve referenced from the Rhino model>)
curve_9 = Curve(<curve referenced from the Rhino model>)
curve_10 = Curve(<curve referenced from the Rhino model>)

center_box = CenterBox(Base=PlaneXY(0, 0, 0), X="100", Y="100", Z="100")
populate_geometry = PopulateGeometry(Geometry=center_box, Count=100, Seed=1)
mesh_sphere = MeshSphere(Base=populate_geometry, Radius=10, UCount=10, VCount=20)
mesh_volume = MeshVolume(Mesh=mesh_sphere)  # -> Volume, Centroid
point_list_3 = PointList(Points=mesh_volume.Centroid, Size="5")

divide_curve_7 = DivideCurve(Curve=curve_7, Count=number_slider_4, Kinks=False)  # -> Points, Tangents, Parameters
divide_curve_8 = DivideCurve(Curve=curve_8, Count=number_slider_4, Kinks=False)  # -> Points, Tangents, Parameters
divide_curve_9 = DivideCurve(Curve=curve_9, Count=number_slider_5, Kinks=False)  # -> Points, Tangents, Parameters
divide_curve_10 = DivideCurve(Curve=curve_10, Count=number_slider_5, Kinks=False)  # -> Points, Tangents, Parameters
point_list_4 = PointList(Points=divide_curve_8.Points, Size="2")
point_list_5 = PointList(Points=divide_curve_7.Points, Size="2")
point_list_6 = PointList(Points=divide_curve_10.Points, Size="2")
point_list_7 = PointList(Points=divide_curve_9.Points, Size="2")
line_4 = Line(StartPoint=divide_curve_7.Points, EndPoint=divide_curve_8.Points)

# ----
# -1 means last item of a list
panel_4 = Panel("-1")
list_item_7 = ListItem(List=divide_curve_6.Points, Index=panel_4, Wrap=True)

line_5 = Line(StartPoint=divide_curve_9.Points, EndPoint=divide_curve_10.Points)
curve_11 = Curve([<curve referenced from the Rhino model> x6])
curve_middle = CurveMiddle(Curve=line_4)
panel_5 = Panel("""a
b
c
d""")
area = Area(Geometry=curve_11)  # -> Area, Centroid
cull_index = CullIndex(List=line_4, Indices="8", Wrap=True)
panel_6 = Panel("""5
7
1
3""")
panel_7 = Panel("""a
b
c
d""")
point_list_8 = PointList(Points=curve_middle, Size="2")
list_item_8 = ListItem(List=reverse(panel_5), Index=0, Wrap=True)
reverse_list = ReverseList(List=panel_5)
list_item_9 = ListItem(List=panel_5, Index=0, Wrap=True)  # -> Item1, Item
merge = Merge(Data1=Toggle(True), Data2=Toggle(False), Data3=Toggle(False))
deconstruct = Deconstruct(Point=area.Centroid)  # -> XComponent, YComponent, ZComponent
panel_8 = Panel(line_4)
panel_9 = Panel(reverse_list)
sort_list = SortList(Keys=panel_6, ValuesA=panel_7)  # -> Keys, ValuesA
cull_pattern = CullPattern(List=line_5, CullPattern=merge)
sort_list_2 = SortList(Keys=deconstruct.XComponent, ValuesA=curve_11)  # -> Keys, ValuesA
boolean = Boolean(invert(merge))
reverse_list_2 = ReverseList(List=merge)
panel_10 = Panel(sort_list.ValuesA)
panel_11 = Panel(boolean)
panel_12 = Panel(reverse_list_2)
area_2 = Area(Geometry=sort_list_2.ValuesA)  # -> Area, Centroid
jitter = Jitter(List=sort_list_2.ValuesA, Jitter=1, Seed=2)  # -> Values, Indices
split_list = SplitList(List=sort_list_2.ValuesA, Index="2")  # -> ListA, ListB
point_list_9 = PointList(Points=area_2.Centroid, Size="3")
custom_preview = CustomPreview(Geometry=split_list.ListA, Material=ColourSwatch(SwatchColor=RGB(60, 0, 255)))
custom_preview_2 = CustomPreview(Geometry=split_list.ListB, Material=ColourSwatch(SwatchColor=RGB(255, 0, 0)))
