# Grasshopper definition attractors.gh (Grasshopper 1.0.7)

range = Range(Domain="0 to 3.00", Steps=10)
# Creare i confini geometrici
# definiamo dei punti all'interno
# creiamo cerchi per ogni punto
# 
# Creiamo un attractor (punto)
# modifichiamo i raggi dei cerchi con l'attractor
construct_point = ConstructPoint(XCoordinate=0, YCoordinate=0, ZCoordinate=0)
unit_x = UnitX(Factor=range)
move = Move(Geometry=construct_point, Motion=unit_x)  # -> Geometry, Transform
range_2 = Range(Domain="0 to 3.00", Steps=10)
geometry = Geometry(move.Geometry)
unit_y = UnitY(Factor=range_2)
graft_tree = GraftTree(Tree=geometry, IncludeEmptyLists=True, IncludeNullItems=True)  # -> simplify(Tree)
tree_branch = TreeBranch(Tree=graft_tree, Path="0", MaintainPaths=True)
param_viewer = ParamViewer(graft_tree)

move_2 = Move(Geometry=graft_tree, Motion=unit_y)  # -> simplify(Geometry), Transform
panel = Panel(move_2.Geometry)
tree_statistics = TreeStatistics(Tree=move_2.Geometry)  # -> Paths, Length, Count
series = Series(Start=0, Step=1, Count=tree_statistics.Length)
graft_tree_2 = GraftTree(Tree=tree_statistics.Paths, IncludeEmptyLists=True, IncludeNullItems=True)  # -> simplify(Tree)
panel_2 = Panel("""{9}_0
{9}_1
..
{9}_10""")
data = Data(simplify(series))
concatenate = Concatenate(FragmentA=graft_tree_2, FragmentB=data, JoinSeparator="_")
panel_3 = Panel(concatenate)
text_tag = TextTag(Location=move_2.Geometry, Text=concatenate)

curve = Curve(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)
point = Point(Point(2.44052061, 2.37970653, 0))

# ----
# Attractor
point_2 = Point(flatten(move_2.Geometry))
distance = Distance(PointA=point, PointB=point_2)
number = Number(distance)
panel_4 = Panel("0.15")
construct_domain = ConstructDomain(DomainStart=Slider(0, range=0..0.15), DomainEnd=Slider(0.15, range=0..0.15))
bounds = Bounds(Numbers=number)
remap_numbers = RemapNumbers(Value=number, Source=bounds, Target=construct_domain)  # -> Mapped, Clipped
circle = Circle(Plane=point_2, Radius=remap_numbers.Mapped)

boundary_surfaces = BoundarySurfaces(Edges=circle)
panel_5 = Panel("0")
panel_6 = Panel("1")

point_3 = Point(flatten(move_2.Geometry))
construct_domain_2 = ConstructDomain(DomainStart=Slider(0, range=0..0.15), DomainEnd=Slider(0.15, range=0..0.15))

curve_closest_point = CurveClosestPoint(Point=point_3, Curve=curve)  # -> Point, Parameter, Distance

number_2 = Number(curve_closest_point.Distance)
bounds_2 = Bounds(Numbers=number_2)
remap_numbers_2 = RemapNumbers(Value=number_2, Source=bounds_2, Target=construct_domain_2)  # -> Mapped, Clipped
circle_2 = Circle(Plane=point_3, Radius=remap_numbers_2.Mapped)

number_3 = Number(remap_numbers.Mapped)
bounds_3 = Bounds(Numbers=number_3)

construct_domain_3 = ConstructDomain(DomainStart=Slider(0, range=0..100), DomainEnd="20")
deconstruct_domain = DeconstructDomain(Domain=construct_domain_3)  # -> Start, End

remap_numbers_3 = RemapNumbers(Value=number_3, Source=bounds_3, Target=construct_domain_3)  # -> Mapped, Clipped
gradient = Gradient(
    LowerLimit=deconstruct_domain.Start,
    UpperLimit=deconstruct_domain.End,
    Parameter=remap_numbers_3.Mapped,
    stops=[0: RGB(0, 128, 0), 0.5: RGB(192, 255, 192), 1: RGB(255, 0, 0)])

custom_preview = CustomPreview(Geometry=boundary_surfaces, Material=gradient)
