# Grasshopper definition numerical_series.gh (Grasshopper 1.0.7)

# ---- group: equivalenti
construct_domain = ConstructDomain(DomainStart=Slider(0, range=-5..5), DomainEnd=Slider(10, range=-5..20))
panel = Panel("0 to 10")

# ----
deconstruct_domain = DeconstructDomain(Domain="0 to 300")  # -> Start, End
subtraction = Subtraction(A=deconstruct_domain.End, B=deconstruct_domain.Start)
division = Division(A=subtraction, B="16.7")
range = Range(Domain="0 to 300", Steps=division)
panel_2 = Panel(range)

panel_3 = Panel("""0
1
2
3
4
5
6
7
8
9
10""")

solo_numeri_pari = Panel("118")
division_2 = Division(A=solo_numeri_pari, B="2")
addition = Addition(A=division_2, B=1)
series = Series(Start=0, Step="2", Count=addition)
panel_4 = Panel(series)

construct_domain_2 = ConstructDomain(DomainStart=Slider(0, range=-5..5), DomainEnd=Slider(10, range=-5..20))

range_2 = Range(Domain=Domain(0, 1), Steps=10)
evaluate = Evaluate(Expression="x²+y³", x=range_2, y="4")
panel_5 = Panel(evaluate)

# ----
# definiamo sezioni strutturali con diametri che vanno da 10 cm a 450 cm con uno step parametrico (2.5 valore iniziale)
panel_6 = Panel("10 to 450")
range_3 = Range(Domain=Domain(0, 1), Steps=10)
# If / Else
curve = Curve([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])
panel_7 = Panel("if(condition,TRUE,FALSE)")
panel_8 = Panel("""5
5
5
5
1
3
5
6""")
# rendere la funzione "parametrica" con l'utilizzo di uno slider
panel_9 = Panel("NOT_OK")
vector_xyz = VectorXYZ(XComponent=0, YComponent=0, ZComponent=0)  # -> Vector, Length
panel_10 = Panel("""5
5
5
5
1
3
5
6""")
deconstruct_domain_2 = DeconstructDomain(Domain=panel_6)  # -> Start, End
range_4 = Range(Domain=construct_domain, Steps="4")

solo_numeri_pari_2 = Panel("118")
division_3 = Division(A=solo_numeri_pari_2, B="2")
series_2 = Series(Start="20", Step="2", Count=expr("x+1", division_3))
panel_11 = Panel(series_2)

range_5 = Range(Domain=construct_domain_2, Steps="4")
expression = Expression(x=range_3, y="4", Expression="x²+y³")
expression_2 = Expression(E=range_3, Jx="4", Expression="E²+Jx³")
series_3 = Series(Start=0, Step=1, Count=10)
deconstruct_arc = DeconstructArc(Arc=curve)  # -> BasePlane, Radius, Angle
integer = Integer(panel_8)
integer_2 = Integer(panel_10)
subtraction_2 = Subtraction(A=deconstruct_domain_2.End, B=deconstruct_domain_2.Start)
evaluate_2 = Evaluate(Expression="if(x>5,5,1)", x=Slider(10, range=0..10))
quick_graph = QuickGraph(expression, SortOrder=0)
center_box = CenterBox(Base=PlaneXY(0, 0, 0), X=1, Y=1, Z=1)
panel_12 = Panel(range_4)
panel_13 = Panel(series_3)
evaluate_3 = Evaluate(Expression="if(x=5,\"SEDIA\",\"NO_SEDIA\")", x=integer_2)
panel_14 = Panel(range_5)
evaluate_4 = Evaluate(Expression="if(x=6,y,z)", x=integer, y="OK", z=panel_9)
panel_15 = Panel("""FLOS_
KARTELL_
MEMPHIS_""")
division_4 = Division(A=subtraction_2, B="2.5")
evaluate_5 = Evaluate(Expression="x > 1.5", x=deconstruct_arc.Radius)
panel_16 = Panel(evaluate_2)
panel_17 = Panel("""STR_
MEP_""")
range_6 = Range(Domain=panel_6, Steps=division_4)
quick_graph_2 = QuickGraph(series_2, SortOrder=0)
panel_18 = Panel(evaluate_3)
format = Format(Format="if(x={0},y,z)", Culture=127, Data0=Slider(5, range=0..10))
panel_19 = Panel(evaluate_4)
panel_20 = Panel("""1
2
3
4
5""")
format_2 = Format(Format="Ciao {0}, lavori per {1}", Culture=127, Data0="Marco", Data1="me stesso")
dispatch = Dispatch(List=curve, DispatchPattern=evaluate_5)  # -> ListA, ListB
geometry = Geometry(center_box)
panel_21 = Panel(range_6)
concatenate = Concatenate(Fragment_A=panel_17, Fragment_B=panel_15, A="1")
panel_22 = Panel(format)
panel_23 = Panel("valori False")
vector_xyz_2 = VectorXYZ(XComponent=series_2, YComponent=0, ZComponent=0)  # -> Vector, Length
panel_24 = Panel(format_2)
concatenate_2 = Concatenate(Fragment_A="A", Fragment_B=panel_20)
panel_25 = Panel(concatenate)
panel_26 = Panel("valori True")
unit_z = UnitZ(Factor="5")
move = Move(Geometry=geometry, Motion=vector_xyz_2.Vector)  # -> Geometry, Transform
unit_z_2 = UnitZ(Factor=1)
panel_27 = Panel(concatenate_2)
extrude = Extrude(Base=dispatch.ListB, Direction=unit_z)
extrude_2 = Extrude(Base=dispatch.ListA, Direction=unit_z_2)
evaluate_6 = Evaluate(Expression=panel_22, x="7")
panel_28 = Panel("""a
b
c
d""")
panel_29 = Panel("""True
True
True
False""")
cull_pattern = CullPattern(List=panel_28, CullPattern=panel_29)
panel_30 = Panel(cull_pattern)
