# Grasshopper definition Curves_introduction.gh (Grasshopper 1.0.7)
# plug-ins: ShapeDiverForGrasshopper

sddb = ShapeDiverDatabase({AbsoluteTolerance=0, AngleTolerance=0, AppDescription="", AppName="unnamed", DocumentName="unnamed", InputGroups="{}", OutputGroups="{\"26288831-6868-4738-98a5-78735fbb8362\":{\"name\":\"ShapeDiver Output\",\"guid\":\"26288831-6868-4738-98a5-78735fbb8362\",\"index\":0,\"params\":[],\"indexFloor\":0,\"indexCeiling\":-1}}", RelativeTolerance=0, UnitSystem=0})
numero_di_punti_sulla_curva = Slider(5, range=3..10)
number_slider = Slider(0.497, range=0..1)
curve = Curve(reparameterize(<curve referenced from the Rhino model>))
curve_2 = Curve(reparameterize(<curve referenced from the Rhino model>))
curve_3 = Curve(<curve referenced from the Rhino model>)
curve_4 = Curve(reparameterize(<curve referenced from the Rhino model>))
panel = Panel("NURBS")
curve_5 = Curve(reparameterize(<curve referenced from the Rhino model>))
curve_6 = Curve(reparameterize(<curve referenced from the Rhino model>))
curve_7 = Curve([<curve referenced from the Rhino model> x2])

curve_8 = Curve(reparameterize(<curve referenced from the Rhino model>))
curve_9 = Curve(reparameterize(<curve referenced from the Rhino model>))
point = Point([<point referenced from the Rhino model> x6])

curve_10 = Curve(reparameterize(<curve referenced from the Rhino model>))
point_2 = Point(<point referenced from the Rhino model>)

curve_11 = Curve(reparameterize(<curve referenced from the Rhino model>))
curve_12 = Curve(reparameterize(<curve referenced from the Rhino model>))
point_3 = Point([<point referenced from the Rhino model> x6])

curve_13 = Curve(reparameterize(<curve referenced from the Rhino model>))
length = Length(Curve=curve_4)
length_2 = Length(Curve=curve_6)

evaluate_length = EvaluateLength(Normalized=True)  # -> Point, Tangent, Parameter
panel_2 = Panel("lunghezza reale")
point_on_curve = PointOnCurve(curve_5, parameter=0.333)

curve_closest_point = CurveClosestPoint(Point=point_2, Curve=reparameterize(curve_10))  # -> Point, Parameter, Distance
curve_closest_point_2 = CurveClosestPoint(Point=point, Curve=curve_9)  # -> Point, Parameter, Distance
evaluate_curve = EvaluateCurve(Curve=curve_2, Parameter=number_slider)  # -> Point, Tangent, Angle
subtraction = Subtraction(A=numero_di_punti_sulla_curva, B=1)
curve_closest_point_3 = CurveClosestPoint(Point=point_3, Curve=curve_12)  # -> Point, Parameter, Distance
evaluate_curve_2 = EvaluateCurve(Curve=curve_3, Parameter=Slider(70.8, range=0..200))  # -> Point, Tangent, Angle
perp_frame = PerpFrame(Curve=curve_2, Parameter=number_slider)
horizontal_frame = HorizontalFrame(Curve=curve_2, Parameter=number_slider)
division = Division(A=length_2, B="2")
unit_y = UnitY(Factor=1)
subtraction_2 = Subtraction(A="14", B=1)
range = Range(Domain=length, Steps="5")
divide_length = DivideLength(Curve=curve_13, Length="2")  # -> Points, Tangents, Parameters
panel_3 = Panel(length)
divide_curve = DivideCurve(Curve=curve, Count=subtraction, Kinks=False)  # -> Points, Tangents, Parameters
panel_4 = Panel(curve_closest_point.Parameter)
divide_curve_2 = DivideCurve(Curve=curve_7, Count=subtraction_2, Kinks=False)  # -> simplify(Points), Tangents, Parameters
divide_curve_3 = DivideCurve(Curve=curve_6, Count=division, Kinks=False)  # -> Points, Tangents, Parameters
panel_5 = Panel("""RGB
XYZ""")
curve_14 = Curve()
deconstruct_plane = DeconstructPlane(Plane=horizontal_frame)  # -> Origin, XAxis, YAxis, ZAxis
evaluate_curve_3 = EvaluateCurve(Curve=curve_11, Parameter=curve_closest_point_3.Parameter)  # -> Point, Tangent, Angle
line_sdl = LineSDL(Start=curve_closest_point_2.Point, Direction=unit_y, Length="200")
multiplication = Multiplication(A=evaluate_curve.Tangent, B=Slider(6.07, range=1..20))
evaluate_curve_4 = EvaluateCurve(Curve=curve_12, Parameter=curve_closest_point_3.Parameter)  # -> Point, Tangent, Angle
graft_tree = GraftTree(Tree=curve_7, IncludeEmptyLists=True, IncludeNullItems=True)  # -> simplify(Tree)
shatter = Shatter(Curve=curve_13, Parameters=divide_length.Parameters)
evaluate_curve_5 = EvaluateCurve(Curve=curve_9, Parameter=curve_closest_point_2.Parameter)  # -> Point, Tangent, Angle
shatter_2 = Shatter(Curve=curve, Parameters=divide_curve.Parameters)
explode_tree = ExplodeTree(Data=divide_curve_2.Points)  # -> Branch0, Branch1
shatter_3 = Shatter(Curve=curve_6, Parameters=divide_curve_3.Parameters)
curve_curve = CurveCurve(CurveA=curve_8, CurveB=line_sdl)  # -> Points, ParamsA, ParamsB
evaluate_length_2 = EvaluateLength(Curve=curve_4, Length=range, Normalized=Toggle(False))  # -> Point, Tangent, Parameter
flatten_tree = FlattenTree(Tree=curve_curve.Points, Path="{0}")
vector_display = VectorDisplay(Anchor=deconstruct_plane.Origin, Vector=deconstruct_plane.ZAxis)
vector_display_ex = VectorDisplayEx(Point=evaluate_curve.Point, Vector=multiplication, Colour=ColourSwatch(SwatchColor=RGB(255, 0, 0)), Width="4")
line = Line(StartPoint=evaluate_curve_3.Point, EndPoint=evaluate_curve_4.Point)
shatter_4 = Shatter(Curve=graft_tree, Parameters=simplify(divide_curve_2.Parameters))
length_3 = Length(Curve=shatter)
line_2 = Line(StartPoint=explode_tree.Branch0, EndPoint=explode_tree.Branch1)
length_4 = Length(Curve=shatter_3)
panel_6 = Panel(length_3)
perp_frame_2 = PerpFrame(Curve=curve_4, Parameter=evaluate_length_2.Parameter)
line_3 = Line(StartPoint=simplify(flatten_tree), EndPoint=evaluate_curve_5.Point)
curve_15 = Curve([shatter_4, line_2])
panel_7 = Panel(curve_curve.Points)
panel_8 = Panel(length_4)
panel_9 = Panel(flatten_tree)
point_4 = Point(flatten_tree)
point_5 = Point(evaluate_curve_5.Point)
point_6 = Point(flatten_tree)
point_7 = Point(evaluate_curve_5.Point)
shift_list = ShiftList(List=point_4, Shift=1, Wrap=True)
shift_list_2 = ShiftList(List=point_6, Shift=1, Wrap=Toggle(False))
# RICORDA
# controllare i tipi di input:
# DataTree e List == attenzione
# Liste di lunghezza di lunghezza differente
shortest_list = ShortestList(ListA=shift_list_2, ListB=point_7, TrimMode=2)  # -> ListA, ListB
line_4 = Line(StartPoint=shift_list, EndPoint=point_5)
line_5 = Line(StartPoint=shortest_list.ListA, EndPoint=shortest_list.ListB)
cull_index = CullIndex(List=line_4, Indices="-1", Wrap=True)
