# Grasshopper definition Surfaces_introduction.gh (Grasshopper 1.0.7)

curve = Curve([<curve referenced from the Rhino model> x4])
curve_2 = Curve([<curve referenced from the Rhino model> x4])
point = Point([<point referenced from the Rhino model> x2])
curve_3 = Curve([<curve referenced from the Rhino model> x4])

unit_z = UnitZ(Factor=1)
geometry = Geometry([<curve referenced from the Rhino model> x3])
unit_vector = UnitVector(Vector=unit_z)
multiplication = Multiplication(A=unit_vector, B="17.5")
vector_length = VectorLength(Vector=multiplication)
extrude = Extrude(Base=geometry, Direction=multiplication)
panel = Panel(vector_length)

list_item = ListItem(List=curve_3, Index=0, Wrap=True)
list_item_2 = ListItem(List=curve, Index=0, Wrap=True)  # -> Item, Item1, Item2, Item3
curve_4 = Curve([<curve referenced from the Rhino model> x4])
curve_5 = Curve([<curve referenced from the Rhino model> x2])
panel_2 = Panel(curve_5)
curve_6 = Curve([<curve referenced from the Rhino model> x2])
panel_3 = Panel(curve_6)
curve_7 = Curve([<curve referenced from the Rhino model> x2])
panel_4 = Panel(curve_7)
flip_curve = FlipCurve(Curve=curve_3, Guide=list_item)  # -> Curve, Flag
list_item_3 = ListItem(List=curve_4, Index=0, Wrap=True)
curve_8 = Curve([<curve referenced from the Rhino model> x4])
curve_9 = Curve(<curve referenced from the Rhino model>)
curve_10 = Curve(<curve referenced from the Rhino model>)
reverse_list = ReverseList(List=curve_5)
reverse_list_2 = ReverseList(List=curve_6)
curve_11 = Curve(<curve referenced from the Rhino model>)
reverse_list_3 = ReverseList(List=curve_7)
edge_surface = EdgeSurface(CurveA=list_item_2.Item, CurveB=list_item_2.Item1, CurveC=list_item_2.Item2, CurveD=list_item_2.Item3)
curve_12 = Curve(<curve referenced from the Rhino model>)
curve_13 = Curve(<curve referenced from the Rhino model>)
patch = Patch(Curves=curve_2, Points=point, Spans=20, Flexibility="10", Trim=True)
curve_14 = Curve(<curve referenced from the Rhino model>)
divide_curve = DivideCurve(Curve=flip_curve.Curve, Count=10, Kinks=False)  # -> Points, Tangents, Parameters
curve_15 = Curve(<curve referenced from the Rhino model>)
curve_16 = Curve(<curve referenced from the Rhino model>)
panel_5 = Panel(reverse_list)
panel_6 = Panel(reverse_list_2)
flip_curve_2 = FlipCurve(Curve=curve_4, Guide=list_item_3)  # -> Curve, Flag
loft = Loft(
    Curves=flip_curve.Curve,
    Options={Adjust=False, Closed=False, LoftEnds=0, LoftSimp=0, LoftType=0, Rebuild=10, Refit=0.01})
boundary_surfaces = BoundarySurfaces(Edges=curve_11)  # -> reparameterize(Surfaces)
curve_17 = Curve([<curve referenced from the Rhino model> x2])
sweep2 = Sweep2(Rail1=curve_9, Rail2=curve_10, Sections=curve_8, SameHeight=False)
boundary_surfaces_2 = BoundarySurfaces(Edges=curve_14)
graft_tree = GraftTree(Tree=reverse_list_3, IncludeEmptyLists=True, IncludeNullItems=True)
panel_7 = Panel(reverse_list_3)
boundary_surfaces_3 = BoundarySurfaces(Edges=reverse_list)
boundary_surfaces_4 = BoundarySurfaces(Edges=reverse_list_2)
extrude_along = ExtrudeAlong(Base=curve_13, Curve=curve_15)
surface_split = SurfaceSplit(Surface=boundary_surfaces, Curves=curve_17)
loft_2 = Loft(
    Curves=flip_curve_2.Curve,
    Options={Adjust=False, Closed=False, LoftEnds=0, LoftSimp=0, LoftType=0, Rebuild=10, Refit=0.01})
revolution = Revolution(Curve=curve_12, Axis=curve_16, Domain=Domain(0, 6.283185307))
loft_options = LoftOptions(Closed=False, Adjust=False, Rebuild=0, Refit=0, Type=0)
panel_8 = Panel(surface_split)
boundary_surfaces_5 = BoundarySurfaces(Edges=graft_tree)
range = Range(Domain=Domain(0, 1), Steps=10)
point_2 = Point(<point referenced from the Rhino model>)
range_2 = Range(Domain=Domain(0, 1), Steps=10)
area = Area(Geometry=surface_split)  # -> Area, Centroid
panel_9 = Panel(boundary_surfaces_5)
graft_tree_2 = GraftTree(Tree=range, IncludeEmptyLists=True, IncludeNullItems=True)
deconstruct_brep = DeconstructBrep(Brep=boundary_surfaces)  # -> Faces, Edges, Vertices
surface_closest_point = SurfaceClosestPoint(Point=point_2, Surface=boundary_surfaces)  # -> Point, UVPoint, Distance
sort_list = SortList(Keys=area.Area, ValuesA=surface_split)  # -> Keys, ValuesA
curve_18 = Curve([<curve referenced from the Rhino model> x2])
construct_point = ConstructPoint(XCoordinate=graft_tree_2, YCoordinate=range_2, ZCoordinate=0)
boundary_surfaces_6 = BoundarySurfaces(Edges=curve_18)
panel_10 = Panel(deconstruct_brep.Edges)
evaluate_surface = EvaluateSurface(Surface=boundary_surfaces, Point=surface_closest_point.UVPoint)  # -> Point, Normal, UDirection, VDirection, Frame
list_item_4 = ListItem(List=sort_list.ValuesA, Index=0, Wrap=True)  # -> Item1, Item
curve_19 = Curve(<curve referenced from the Rhino model>)
plane = Plane(PlaneXY(406.8834771, 120.3701476, 0))
orient = Orient(Source=PlaneXY(0, 0, 0), Target=PlaneXY(0, 0, 0))  # -> Geometry, Transform
evaluate_surface_2 = EvaluateSurface(Surface=reparameterize(loft), Point=simplify(construct_point))  # -> Point, Normal, UDirection, VDirection, Frame
panel_11 = Panel(deconstruct_brep.Vertices)
brep_join = BrepJoin(Breps=boundary_surfaces_6)  # -> Breps, Closed
surface = Surface(list_item_4.Item1)
geometry_2 = Geometry(brep_join.Breps)
panel_12 = Panel(brep_join.Breps)
panel_13 = Panel(evaluate_surface_2.Point)
orient_2 = Orient(Geometry=curve_19, Source=plane, Target=evaluate_surface_2.Frame)  # -> Geometry, Transform
