# Grasshopper definition Palazzina.gh (Grasshopper 1.0.7)
# plug-ins: Human, eleFront, Pufferfish

interpiano = Panel("5")
interpiano_2 = Panel("3")
series = Series(Start=interpiano, Step=interpiano_2, Count=Slider(20, range=1..40))
dynamic_geometry_pipeline = DynamicGeometryPipeline(
    LayerFilter="Default",
    TypeFilter="Curve",
    NameFilter="slab",
    GroupByLayer=False,
    GroupByType=False,
    IncludeHidden=True,
    IncludeLocked=True,
    enableFullPath=False,
    listenToAttributes=True)
cull_index = CullIndex(List=series, Indices="17", Wrap=True)
panel = Panel(dynamic_geometry_pipeline)
unit_z = UnitZ(Factor=cull_index)
move = Move(Geometry=dynamic_geometry_pipeline, Motion=unit_z)  # -> Geometry, Transform
construct_domain = ConstructDomain(DomainStart=0, DomainEnd=Slider(90, range=60..120))
list_length = ListLength(List=move.Geometry)  # -> expr("x -1", Length)
area = Area(Geometry=move.Geometry)  # -> Area, Centroid
range = Range(Domain=construct_domain, Steps=list_length)
radians = Radians()
rotate = Rotate(Geometry=move.Geometry, Angle=degrees(range), Plane=area.Centroid)  # -> Geometry, Transform
list_length_2 = ListLength(List=rotate.Geometry)  # -> expr("x-1", Length)
range_2 = Range(Domain=Domain(0, 1), Steps=list_length_2)
area_2 = Area(Geometry=rotate.Geometry)  # -> Area, Centroid
graph_mapper = GraphMapper(range_2, x0=0, x1=1, y0=0, y1=1, container_name="Bezier", cpx=[0, 0.2241182178, 0.9023533463, 1], cpy=[1, 0, 0, 1])
panel_2 = Panel(graph_mapper)
bounds = Bounds(Numbers=panel_2)
remap_numbers = RemapNumbers(Value=panel_2, Source=Domain(0, 1), Target="0.5 to 1.2")  # -> Mapped, Clipped
panel_3 = Panel(bounds)
scale = Scale(Geometry=rotate.Geometry, Center=area_2.Centroid, Factor=remap_numbers.Mapped)  # -> Geometry, Transform
bounds_2 = Bounds(Numbers=remap_numbers.Mapped)
panel_4 = Panel(bounds_2)
boundary_surfaces = BoundarySurfaces(Edges=scale.Geometry)
md_slider = MDSlider(SliderMode=0, slider_value=Point(0.5, 0.5, 0.5), x_domain=Domain(0, 1), y_domain=Domain(0, 1), z_domain=Domain(0, 1))
evaluate_surface = EvaluateSurface(Surface=reparameterize(boundary_surfaces), Point=md_slider)  # -> Point, Normal, UDirection, VDirection, Frame
curve = Curve(scale.Geometry)
multiplication = Multiplication(A=evaluate_surface.Normal, B="0.30")
extrude = Extrude(Base=boundary_surfaces, Direction=multiplication)
length = Length(Curve=curve)
division = Division(A=length, B="10")
sort_list = SortList(Keys=division)  # -> reverse(Keys), ValuesA
sort_list_2 = SortList(Keys=division)  # -> Keys, ValuesValuesA
list_item = ListItem(List=sort_list.Keys, Index=0, Wrap=True)
list_item_2 = ListItem(List=sort_list_2.Keys, Index=0, Wrap=True)  # -> Item1, Item
divide_curve = DivideCurve(Curve=curve, Count=list_item, Kinks=False)  # -> simplify(Points), Tangents, Parameters
flip_matrix = FlipMatrix(Data=divide_curve.Points)
polyline = PolyLine(Vertices=flip_matrix, Closed=False)
panel_5 = Panel(flip_matrix)
explode = Explode(Curve=polyline, Recursive=True)  # -> simplify(Segments), Vertices
slabs = Geometry(extrude)
list_length_3 = ListLength(List=slabs)
panel_6 = Panel(explode.Segments)
pipe = Pipe(Curve=explode.Segments, Radius=1, Caps=0)  # -> simplify(Pipe)
series_2 = Series(Start=0, Step=1, Count=list_length_3)
shift_paths = ShiftPaths(Data=pipe, Offset=-1)
volume = Volume(Geometry=slabs)  # -> Volume, Centroid
range_3 = Range(Domain=Domain(0, 1), Steps=expr("x-1", list_length_3))
flip_matrix_2 = FlipMatrix()
graft_tree = GraftTree(IncludeEmptyLists=True, IncludeNullItems=True)
merge = Merge(Data1=ColourSwatch(SwatchColor=RGB(255, 0, 0)), Data2=ColourSwatch(SwatchColor=RGB(0, 55, 255)))
flatten_tree = FlattenTree(Path="{0}")
tree_branch = TreeBranch(MaintainPaths=True)
explode_tree = ExplodeTree()  # -> Branch0, Branch1
panel_7 = Panel("""12
c""")
deconstruct = Deconstruct(Point=volume.Centroid)  # -> XComponent, YComponent, ZComponent
tween_through_colors = TweenThroughColors(
    Colors=merge,
    Factor=range_3,
    Normalized=True,
    Equalized=False,
    Weighted=False,
    Loopback=False,
    Degree=3,
    InterpolationType=0,
    Alpha=True)
format = Format(Format="Slab::slab {0}", Culture=127, Data0=series_2)
graft_tree_2 = GraftTree(Tree=volume.Volume, IncludeEmptyLists=True, IncludeNullItems=True)
graft_tree_3 = GraftTree(Tree=deconstruct.ZComponent, IncludeEmptyLists=True, IncludeNullItems=True)
merge_2 = Merge(Data1="a", Data2=panel_7)
column = Geometry(shift_paths)
panel_8 = Panel("""livello
Volume""")
elefront_layer = EleFrontLayer(FullPath=format, DisplayColour=tween_through_colors)  # -> Layer, FullPath, Hidden, Locked, DisplayColour, MaterialName, Linetype, PrintColour, PrintWidth
merge_3 = Merge(Data1=simplify(graft_tree_3), Data2=simplify(graft_tree_2))
series_3 = Series(Start=0, Step=1, Count=10)
panel_9 = Panel(merge_2)
concatenate = Concatenate(Fragment_A="MainLayer::SubLayer::subsubLayer", Fragment_B="::", A=series_3)
graft_tree_4 = GraftTree(Tree=elefront_layer.Layer, IncludeEmptyLists=True, IncludeNullItems=True)  # -> simplify(Tree)
panel_10 = Panel(concatenate)
graft_tree_5 = GraftTree(Tree=slabs, IncludeEmptyLists=True, IncludeNullItems=True)
panel_11 = Panel(merge_3)
elefront_attributes = EleFrontAttributes(Keys=panel_8, Values=simplify(merge_3), Layer=graft_tree_4)  # -> Attributes, Keys, Values, Name, Layer, ColourSource, DisplayColour, MaterialSource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
elefront_layer_2 = EleFrontLayer(FullPath=concatenate)  # -> Layer, FullPath, Hidden, Locked, DisplayColour, MaterialName, Linetype, PrintColour, PrintWidth
bake_objects = BakeObjects(
    Geometry=simplify(graft_tree_5),
    Attributes=elefront_attributes.Attributes,
    BakeName="myBake",
    Bake=Toggle(True),
    createGroups=False)  # -> Message, Guids
bake_layers = BakeLayers(Layers=elefront_layer_2.Layer, Bake=False)
reference_by_layer = ReferenceByLayer(LayerName=format, lightweight=False)  # -> simplify(Geometry)
tree_statistics = TreeStatistics(Tree=reference_by_layer)  # -> Paths, Length, Count
format_2 = Format(Format="la mia slab {0}_construction", Culture=127, Data0=tree_statistics.Paths)
graft_tree_6 = GraftTree(Tree=format_2, IncludeEmptyLists=True, IncludeNullItems=True)
export_generic = ExportGeneric(
    FolderPath="C:\Users\Marco\Desktop\MyFolder",
    FileName=graft_tree_6,
    FileExtension=".obj",
    RhinoObjects=reference_by_layer,
    AxisSystem=PlaneXY(0, 0, 0),
    Export=Toggle(True),
    Overwrite=False,
    networkMode=True)
export_to_rhino_file = ExportToRhinoFile(Overwrite=False, networkMode=True)
