# Grasshopper definition elefront.gh (Grasshopper 1.0.7)
# plug-ins: eleFront

value_list = ValueList({"Default", "Layer 01", "Layer 02", "Layer 03", "Layer 04", "Layer 05", "Slab"}, selected="Slab")
reference_by_layer = ReferenceByLayer(LayerName=value_list, lightweight=False, DisableAutoUpdate=False)
value_list_2 = ValueList({"Point", "Curve", "Arc", "Circle", "Ellipse", "Line", "Polyline", "Brep", "Surface", "Polysurface", "Extrusion", "Block", "Text", "TextDot", "Dimension", "LinearDimension", "AngularDimension", "RadialDimension", "Hatch", "Leader"}, selected="Surface")
filter_by_type = FilterByType(ObjectType=value_list_2, Geometry=reference_by_layer, invertFilter=False, returnNulls=False)  # -> ExcludedGeometry, IncludedGeometry
panel = Panel("""steel
0.6""")
panel_2 = Panel("""material
thickness""")
geometry = Geometry(filter_by_type.IncludedGeometry)
elefront_attributes = EleFrontAttributes(Keys=panel_2, Values=panel)  # -> Attributes, Keys, Values, Name, Layer, ColourSource, DisplayColour, MaterialSource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
sphere = Sphere(Base=PlaneXY(0, 0, 0), Radius=1)
get_all_keys_values = GetAllKeysValues(AttributesOrAttributedGeometry=geometry)  # -> simplify(Keys), Values, BakeName
get_user_value = GetUserValue(Geometry=geometry, Key="material")
attach_attributes = AttachAttributes(Geometry=sphere, Attributes=elefront_attributes.Attributes)
panel_3 = Panel(get_user_value)
panel_4 = Panel(get_all_keys_values.Values)
bake_objects = BakeObjects(Geometry=attach_attributes, Attributes=elefront_attributes.Attributes, Bake=False, createGroups=False)  # -> Message, Guids
