# Grasshopper definition Building_Karamba3d.gh (Grasshopper 1.0.7)
# plug-ins: Karamba3D, Kangaroo2 Components, eleFront

colour_swatch = ColourSwatch(SwatchColor=RGB(255, 10, 10))

expression = Expression(E="20000", v="0.30", Expression="E / ( 2 * (1 + v) )")
panel = Panel("G = E/ 2(1+v)")
material_properties_karamba3d = MaterialPropertiesKaramba3D(
    FamilyOfMaterial="Steel",
    Name="S235_type1",
    Color=colour_swatch,
    YoungsModulus_kN_cm2="20000",
    InPlaneShearModulus_kN_cm2=expression,
    TransverseShearModulus_kN_cm2=expression,
    SpecificWeight_kN_m3=78.5,
    CoefficientOfThermalExpansion_1_C=1.2e-05,
    TensileStrength_kN_cm2=23.5,
    CompressiveStrength_kN_cm2=-23.5,
    StrengthHypothesis="MISES",
    mode="Isotrop")

panel_2 = Panel("Unità in metri")
cross_section_range_selector_karamba3d = CrossSectionRangeSelectorKaramba3D(MaximumHeight_cm=-1, MaximumWidth_cm=-1, Color=colour_swatch, menu=[dropdown(1), dropdown(1), dropdown(0)])

curve = Curve(<curve referenced from the Rhino model>)
boundary_surfaces = BoundarySurfaces(Edges=curve)
point = Point([<point referenced from the Rhino model> x3])
mesh_breps_karamba3d = MeshBrepsKaramba3D(
    Brep=boundary_surfaces,
    InclusionPoints=point,
    MeshResolution="0.50",
    EdgeRefinementFactor=0.67,
    PointReduction=False,
    SmoothingStepSize=0,
    SmoothingIterations=5)  # -> Mesh, Info
point_2 = Point(point)
mesh = Mesh(mesh_breps_karamba3d.Mesh)
quad_remesh_settings = QuadRemeshSettings(TargetCount="200", AdaptiveSize=0, AdaptiveCount=False, HardEdges=False, SeamEdges=0, Symmetry=0, GuideCurves=0)
curve_2 = Curve([<curve referenced from the Rhino model> x2])
triremesh = TriRemesh(Geometry=mesh, Features=point_2, Length="1.0", Iterations="20")  # -> Triangulation, Dual, Creases
quad_remesh = QuadRemesh(Mesh=mesh, Guides=curve_2, Settings=quad_remesh_settings)
mesh_2 = Mesh(triremesh.Triangulation)
panel_3 = Panel(quad_remesh)

panel_4 = Panel("""S235
S275
S355""")
material_selection_karamba3d = MaterialSelectionKaramba3D(NameOrListIndexOfMaterial="S235", menu=[dropdown(1), dropdown(0)])
panel_5 = Panel(cross_section_range_selector_karamba3d)

cross_section_selector_karamba3d = CrossSectionSelectorKaramba3D(
    CrossSections=cross_section_range_selector_karamba3d,
    NameOrListIndexOfCrossSection="hea 200",
    Material=material_properties_karamba3d)  # -> CrossSection, Info

material_selection_karamba3d_2 = MaterialSelectionKaramba3D(menu=[dropdown(1), dropdown(4)])
material_selection_karamba3d_3 = MaterialSelectionKaramba3D(NameOrListIndexOfMaterial=panel_4, menu=[dropdown(1), dropdown(0)])
cross_section_karamba3d = CrossSectionKaramba3D(FamilyNameOfCrossSection="DefaultCroSec", Height_cm=10, UpperFlangeWidth_cm=5, LowerFlangeWidth_cm=5, mode="Trapezoid")
list_item = ListItem(List=cross_section_range_selector_karamba3d, Index="47", Wrap=True)
disassemble_material_karamba3d = DisassembleMaterialKaramba3D(Material=material_selection_karamba3d)  # -> Material, TypeOfMaterial, FamilyNameOfMaterial, NameOfMaterial, ElemIdentifiers, Color, YoungsModulusKNCm2Dir12, InPlaneShearModulus_kN_cm2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
panel_6 = Panel(material_selection_karamba3d_3)
panel_7 = Panel(list_item)
panel_8 = Panel(material_selection_karamba3d_2)
material_properties_karamba3d_2 = MaterialPropertiesKaramba3D(
    FamilyOfMaterial="Steel",
    Name=disassemble_material_karamba3d.NameOfMaterial,
    ElementIdentifier=disassemble_material_karamba3d.ElemIdentifiers,
    Color=disassemble_material_karamba3d.Color,
    YoungsModulus_kN_cm2=disassemble_material_karamba3d.YoungsModulusKNCm2Dir12,
    InPlaneShearModulus_kN_cm2=disassemble_material_karamba3d.InPlaneShearModulus_kN_cm2,
    TransverseShearModulus_kN_cm2=disassemble_material_karamba3d.TransverseShearModulusKNCm2Dir12,
    SpecificWeight_kN_m3="80",
    CoefficientOfThermalExpansion_1_C=disassemble_material_karamba3d.CoefficientOfThermalExpansion1CDir12,
    TensileStrength_kN_cm2=disassemble_material_karamba3d.TensileStrengthKNCm2Dir12,
    CompressiveStrength_kN_cm2=disassemble_material_karamba3d.CompressiveStrengthKNCm2Dir12,
    StrengthHypothesis=disassemble_material_karamba3d.StrengthHypothesis,
    mode="Isotrop")
curve_3 = Curve([<curve referenced from the Rhino model> x39])
curve_middle = CurveMiddle(Curve=curve_3)
deconstruct = Deconstruct(Point=curve_middle)  # -> XComponent, YComponent, ZComponent
create_set = CreateSet(List=deconstruct.ZComponent)  # -> Set, Map
colour_swatch_2 = ColourSwatch(SwatchColor=RGB(255, 255, 255))
member_index = MemberIndex(Set=deconstruct.ZComponent, Member=create_set.Set)  # -> Index, Count
list_item_2 = ListItem(List=curve_3, Index=member_index.Index, Wrap=True)

# ----
# Wall
material_selection_karamba3d_4 = MaterialSelectionKaramba3D(menu=[dropdown(7), dropdown(6)])
surface = Surface([<surface referenced from the Rhino model> x6])
cross_section_karamba3d_2 = CrossSectionKaramba3D(FamilyNameOfCrossSection="DefaultCroSec", Material=material_selection_karamba3d_4, Height_cm="30", mode="Shell - Const")
mesh_surface = MeshSurface(Surface=surface, UCount=5, VCount=5, Overhang=True, Equalize=False)
mesh_to_shell_karamba3d = MeshToShellKaramba3D(Mesh=mesh_surface, CrossSection=cross_section_karamba3d_2, LimitDistance_m=0.005)  # -> Element, Points, Info

# ----
# Slab
material_selection_karamba3d_5 = MaterialSelectionKaramba3D(Color=colour_swatch_2, menu=[dropdown(7), dropdown(6)])
surface_2 = Surface([<surface referenced from the Rhino model> x14])
cross_section_karamba3d_3 = CrossSectionKaramba3D(FamilyNameOfCrossSection="DefaultCroSec", Material=material_selection_karamba3d_5, Height_cm="30", mode="Shell - Const")
mesh_surface_2 = MeshSurface(Surface=surface_2, UCount=5, VCount=5, Overhang=True, Equalize=False)
mesh_to_shell_karamba3d_2 = MeshToShellKaramba3D(Mesh=mesh_surface_2, CrossSection=cross_section_karamba3d_3, LimitDistance_m=0.005)  # -> Element, Points, Info

_1_mm = Panel("0.001")
panel_9 = Panel("2")  # "kN/ml"
reference_by_layer = ReferenceByLayer(LayerName="Column", lightweight=False)
unit_z = UnitZ(Factor=1)
unit_z_2 = UnitZ(Factor=1)
mesh_3 = Mesh(mesh_surface_2)
negative = Negative(Value="4")
concatenate = Concatenate()
unit_z_3 = UnitZ(Factor=negative)
loads_karamba3d = LoadsKaramba3D(Vector=Vector(0, 0, -1), LCase="0", mode="Gravity")
get_all_keys_values = GetAllKeysValues(AttributesOrAttributedGeometry=reference_by_layer)  # -> Keys, Values, BakeName
get_user_value = GetUserValue(Geometry=reference_by_layer, Key="release")  # -> flatten(Values)
panel_10 = Panel(loads_karamba3d)
line_to_beam_karamba3d = LineToBeamKaramba3D(
    Line=reference_by_layer,
    New=True,
    Remove=True,
    LimitDistance_m=0.005,
    Bending=True,
    SetBucklingLength=True,
    ToPolylineMaxAngle=0.03,
    ToPolylineTolerance=0.01,
    ToPolylineMaxEdgeLength=0.25)  # -> Element, Points, Info
loads_karamba3d_2 = LoadsKaramba3D(Vector=unit_z_3, Mesh=mesh_3, LCase="3", mode="MeshLoad -Const.", menu=[buttons(off, on, off), buttons(on, on)])
beam_joints_karamba3d = BeamJointsKaramba3D(
    CtKNMAtStartingNode=Vector(0, 0, 0),
    CrKNmRadAtStartingNode=Vector(0, 0, 0),
    CtKNMAtEndNode=Vector(0, 0, 0),
    CrKNmRadAtEndNode=Vector(0, 0, 0),
    menu=[buttons(off, off, off, off, off, off), buttons(off, off, off, off, off, off)])
panel_11 = Panel(get_all_keys_values.Keys)
panel_12 = Panel("&Colonne")

# ----
# Colonne
curve_4 = Curve([<curve referenced from the Rhino model> x39])

list_length = ListLength(List=curve_4)
series = Series(Start=0, Step=1, Count=list_length)
curve_middle_2 = CurveMiddle(Curve=curve_4)
curve_5 = Curve(curve_4)
concatenate_2 = Concatenate(FragmentA="Colonne", FragmentB=series)
length = Length(Curve=curve_5)

curve_6 = Curve(curve_4)
panel_13 = Panel("2")  # "kN/ml"
length_2 = Length(Curve=curve_6)
multiplication = Multiplication(A=length_2, B=panel_13)
division = Division(A=multiplication, B="2")
end_points = EndPoints(Curve=curve_6)  # -> Start, End
unit_x = UnitX(Factor=division)
entwine = Entwine(Branch00=end_points.Start, Branch01=end_points.End, FlattenInputs=True)
loads_karamba3d_3 = LoadsKaramba3D(ForceVector=unit_x, Local=False, PosInd=entwine, LCase="1", mode="Point")

point_list = PointList(Points=curve_middle_2)
multiplication_2 = Multiplication(A=length, B=panel_9)

line_to_beam_karamba3d_2 = LineToBeamKaramba3D(
    Line=curve_4,
    Identifier=concatenate_2,
    CrossSection=cross_section_selector_karamba3d.CrossSection,
    New=True,
    Remove=True,
    LimitDistance_m=0.005,
    Bending=True,
    SetBucklingLength=True,
    ToPolylineMaxAngle=0.03,
    ToPolylineTolerance=0.01,
    ToPolylineMaxEdgeLength=0.25)  # -> Element, Points, Info

element_karamba3d = ElementKaramba3D(line_to_beam_karamba3d_2.Element)
disassemble_element_karamba3d = DisassembleElementKaramba3D(Element=element_karamba3d)  # -> Element, ElementIdentifier, AxisOfElement, CrossSection, Joint, Material, LocalCoordinateSystem, ElementIsActive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
division_2 = Division(A=multiplication_2, B="2")
end_points_2 = EndPoints(Curve=curve_5)  # -> Start, End
curve_7 = Curve(disassemble_element_karamba3d.AxisOfElement)
unit_x_2 = UnitX(Factor=division_2)
disassemble_element_karamba3d_2 = DisassembleElementKaramba3D(Element=line_to_beam_karamba3d_2.Element)  # -> Element, ElementIdentifier, AxisOfElement, CrossSection, Joint, Material, LocalCoordinateSystem, ElementIsActive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
end_points_3 = EndPoints(Curve=curve_7)  # -> Start, End
perp_frame = PerpFrame(Curve=reparameterize(curve_7), Parameter="0.50")
deconstruct_2 = Deconstruct(Point=end_points_3.End)  # -> XComponent, YComponent, ZComponent
evaluate = Evaluate(Expression="x^2", x=deconstruct_2.ZComponent)
list_item_3 = ListItem(List=disassemble_element_karamba3d_2.ElementIdentifier, Index="31", Wrap=True)
deconstruct_plane = DeconstructPlane(Plane=perp_frame)  # -> Origin, XAxis, YAxis, ZAxis
loads_karamba3d_4 = LoadsKaramba3D(ForceVector=unit_x_2, Local=False, PosInd=end_points_2.End, LCase="1", mode="Point")
loads_karamba3d_5 = LoadsKaramba3D(ForceVector=unit_x_2, Local=False, PosInd=end_points_2.Start, LCase="1", mode="Point")
beam_joints_karamba3d_2 = BeamJointsKaramba3D(
    AtElementIdentifiers=list_item_3,
    CtKNMAtStartingNode=Vector(0, 0, 0),
    CrKNmRadAtStartingNode=Vector(0, 0, 0),
    CtKNMAtEndNode=Vector(0, 0, 0),
    CrKNmRadAtEndNode=Vector(0, 0, 0),
    menu=[buttons(off, off, off, off, off, on), buttons(off, off, off, off, off, off)])
multiplication_3 = Multiplication(A=deconstruct_plane.XAxis, B=evaluate)
beam_loads_karamba3d = BeamLoadsKaramba3D(
    BeamIdentifier=element_karamba3d,
    LoadCase="4",
    ForceVector=multiplication_3,
    TStart=0,
    TEnd=1,
    mode="Block",
    menu=[buttons(off, on, off)])
joint_karamba3d = JointKaramba3D(beam_joints_karamba3d_2)

# ----
# Travi
material_selection_karamba3d_6 = MaterialSelectionKaramba3D(Color=colour_swatch_2, menu=[dropdown(7), dropdown(6)])
curve_8 = Curve([<curve referenced from the Rhino model> x47])
panel_14 = Panel("Digit \"Scribble\" on canvas")

concatenate_3 = Concatenate(Fragment_A="30", Fragment_B="x", A="60")

cross_section_karamba3d_4 = CrossSectionKaramba3D(
    FamilyNameOfCrossSection="DefaultCroSec",
    NameOfCrossSection=concatenate_3,
    Material=material_selection_karamba3d_6,
    Height_cm="60",
    UpperFlangeWidth_cm="30",
    LowerFlangeWidth_cm="30",
    mode="Trapezoid")
line_to_beam_karamba3d_3 = LineToBeamKaramba3D(
    Line=curve_8,
    CrossSection=cross_section_karamba3d_4,
    New=True,
    Remove=True,
    LimitDistance_m=0.005,
    Bending=True,
    SetBucklingLength=True,
    ToPolylineMaxAngle=0.03,
    ToPolylineTolerance=0.01,
    ToPolylineMaxEdgeLength=0.25)  # -> Element, Points, Info

point_3 = Point(flatten([line_to_beam_karamba3d_2.Points, line_to_beam_karamba3d_3.Points, mesh_to_shell_karamba3d_2.Points, mesh_to_shell_karamba3d.Points]))
deconstruct_3 = Deconstruct(Point=point_3)  # -> XComponent, YComponent, ZComponent
bounds = Bounds(Numbers=deconstruct_3.ZComponent)
deconstruct_domain = DeconstructDomain(Domain=bounds)  # -> Start, End
addition = Addition(A=deconstruct_domain.Start, B=_1_mm)
smaller_than = SmallerThan(FirstNumber=deconstruct_3.ZComponent, SecondNumber=addition)  # -> SmallerThan, OrEqualTo
element_karamba3d_2 = ElementKaramba3D(line_to_beam_karamba3d_3.Element)
cull_pattern = CullPattern(List=point_3, CullPattern=smaller_than.SmallerThan)
element_karamba3d_3 = ElementKaramba3D(line_to_beam_karamba3d_3.Element)
remove_duplicate_points_karamba3d = RemoveDuplicatePointsKaramba3D(Point=cull_pattern, LimitDistance="0.001")  # -> OutPoint, Info, Indexes
xy_plane = XYPlane(Origin=remove_duplicate_points_karamba3d.OutPoint)
beam_loads_karamba3d_2 = BeamLoadsKaramba3D(
    BeamIdentifier=element_karamba3d_2,
    LoadCase="2",
    ForceVector=unit_z,
    TPosition="0.25",
    mode="Concentrated",
    menu=[buttons(off, on)])
beam_loads_karamba3d_3 = BeamLoadsKaramba3D(
    BeamIdentifier=element_karamba3d_3,
    LoadCase="2",
    ForceVector=unit_z_2,
    TStart=0,
    TEnd=1,
    mode="Block",
    menu=[buttons(on, off, off)])
rotate_plane = RotatePlane(Plane=xy_plane, Angle=degrees("90"))
support_karamba3d = SupportKaramba3D(PosInd=remove_duplicate_points_karamba3d.OutPoint, PlaneOfReference=rotate_plane, menu=[buttons(on, on, on, on, on, on)])
element_karamba3d_4 = ElementKaramba3D([line_to_beam_karamba3d_2.Element, line_to_beam_karamba3d_3.Element, mesh_to_shell_karamba3d_2.Element, mesh_to_shell_karamba3d.Element])
support_karamba3d_2 = SupportKaramba3D(support_karamba3d)
load_karamba3d = LoadKaramba3D(flatten([beam_loads_karamba3d_2, beam_loads_karamba3d_3, loads_karamba3d_2, loads_karamba3d_3, loads_karamba3d, beam_loads_karamba3d]))
element_karamba3d_5 = ElementKaramba3D(flatten(element_karamba3d_4))
load_karamba3d_2 = LoadKaramba3D(flatten(load_karamba3d))
support_karamba3d_3 = SupportKaramba3D(support_karamba3d_2)
assemble_model_karamba3d = AssembleModelKaramba3D(
    Elem=element_karamba3d_5,
    Support=support_karamba3d_3,
    Load=load_karamba3d_2,
    Joint=joint_karamba3d,
    LimitDistance_m=0.005)  # -> Model, Info, Mass_kg, CenterOfGravity, LoadCaseNames
analyze_karamba3d = AnalyzeKaramba3D(Model=assemble_model_karamba3d.Model)  # -> CalculatedModel, MaximumDisplacement_cm, ResultingForceOfGravity_kN, ElasticEnergyChange_kNm
model_view_karamba3d = ModelViewKaramba3D(Model=analyze_karamba3d.CalculatedModel, ResultFactors=1, ResultCase=-1, ElementIdentifiersBreps="&Colonne1")  # -> Model, DeformedMesh, DeformedAxes, DeformedModel
beam_view_karamba3d = BeamViewKaramba3D(Model=model_view_karamba3d.Model)  # -> Model, MeshesOfRenderedBeams, DeformedBeamAxes, LegendColors, LegendTags
