# Grasshopper definition load_combination.gh (Grasshopper 1.0.7)
# plug-ins: Karamba3D

panel = Panel("""COMBO_NAME,DL,SDL,WIND,SNOW,FOLLA
A,1,0,0,0,0
B,0,1,0,0,0
C,0,0,1,0,0
D,0,0,0,1,0
E,0,0,0,0,1
F,1.3,1.5,1.5,0,0
G,1.3,1.5,1.5,0,1.5""")
cull_i = CullIndex(List=panel, Indices=0, Wrap=True)
split = TextSplit(Text=cull_i, Separators=",")  # -> simplify(Result)
flip = FlipMatrix(Data=split)  # -> simplify(Data)
bang = ExplodeTree(Data=flip)  # -> simplify(graft(Branch0)), simplify(graft(Branch1)), simplify(graft(Branch2)), simplify(graft(Branch3)), simplify(graft(Branch4)), simplify(graft(Branch5))

rectangle = Rectangle(Plane=PlaneXY(0, 0, 0), XSize=Domain(-1, 1), YSize=Domain(-2, 2), Radius=0)  # -> Rectangle, Length
number_slider = Slider(70, range=0..120)
number_slider_2 = Slider(56, range=0..120)
number_slider_3 = Slider(18, range=0..120)
number_slider_4 = Slider(86, range=0..120)
mesh_surface = MeshSurface(Surface=rectangle.Rectangle, UCount="10", VCount="10", Overhang=True, Equalize=False)
deconstruct_mesh = DeconstructMesh(Mesh=mesh_surface)  # -> Vertices, Faces, Colours, Normals

# ----
# SDL - G2
panel_2 = Panel("4.00")  # "kN/mq"
negative = Negative(Value=panel_2)
unit_z = UnitZ(Factor=negative)
multiplication = Multiplication(A=unit_z, B=bang.Branch2)
loads_karamba3d = LoadsKaramba3D(
    Vector=multiplication,
    Mesh=mesh_surface,
    LCase=bang.Branch0,
    mode="MeshLoad -Const.",
    menu=[buttons(off, on, off), buttons(on, on)])

# ----
# Folla
panel_3 = Panel("10")
deconstruct_mesh_2 = DeconstructMesh(Mesh=mesh_surface)  # -> Vertices, Faces, Colours, Normals
negative_2 = Negative(Value=panel_3)
unit_z_2 = UnitZ(Factor=negative_2)
list_item = ListItem(List=deconstruct_mesh_2.Vertices, Index="20", Wrap=True)
multiplication_2 = Multiplication(A=unit_z_2, B=bang.Branch5)
loads_karamba3d_2 = LoadsKaramba3D(ForceVector=multiplication_2, Local=False, PosInd=list_item, LCase=bang.Branch0, mode="Point")

list_item_2 = ListItem(List=deconstruct_mesh.Vertices, Index=[number_slider, number_slider_2, number_slider_3, number_slider_4], Wrap=True)
unit_x = UnitX(Factor="0.50")
point = Point(list_item_2)
multiplication_3 = Multiplication(A=unit_x, B=bang.Branch3)
support_karamba3d = SupportKaramba3D(PosInd=point, menu=[buttons(on, on, on, on, on, on)])
mesh_to_shell_karamba3d = MeshToShellKaramba3D(Mesh=mesh_surface, LimitDistance_m=0.005)  # -> Element, Points, Info
unit_z_3 = UnitZ(Factor=expr("-x", bang.Branch1))
negative_3 = Negative()
loads_karamba3d_3 = LoadsKaramba3D(Vector=unit_z_3, LCase=bang.Branch0, mode="Gravity")
loads_karamba3d_4 = LoadsKaramba3D(
    Vector=multiplication_3,
    Mesh=mesh_surface,
    LCase=bang.Branch0,
    mode="MeshLoad -Const.",
    menu=[buttons(off, on, off), buttons(on, on)])
load_karamba3d = LoadKaramba3D(flatten([loads_karamba3d_3, loads_karamba3d, loads_karamba3d_4, loads_karamba3d_2]))
assemble_model_karamba3d = AssembleModelKaramba3D(Elem=mesh_to_shell_karamba3d.Element, Support=support_karamba3d, Load=load_karamba3d, LimitDistance_m=0.005)  # -> Model, Info, Mass_kg, CenterOfGravity, LoadCaseNames
analyze_karamba3d = AnalyzeKaramba3D(Model=assemble_model_karamba3d.Model)  # -> CalculatedModel, MaximumDisplacement_cm, ResultingForceOfGravity_kN, ElasticEnergyChange_kNm
nodal_displacements_karamba3d = NodalDisplacementsKaramba3D(AnalyzedModel=analyze_karamba3d.CalculatedModel)  # -> AnalyzedModel, NodalTranslations_m, NodalRotations_rad
vector_length = VectorLength(Vector=nodal_displacements_karamba3d.NodalTranslations_m)
sort_list = SortList(Keys=vector_length)  # -> Keys, ValuesA
model_view_karamba3d = ModelViewKaramba3D(Model=analyze_karamba3d.CalculatedModel, ResultFactors=1, ResultCase=Slider(0, range=0..6))  # -> Model, DeformedMesh, DeformedAxes, DeformedModel
populate_geometry = PopulateGeometry(Geometry=mesh_surface, Count=100, Seed=1)
list_item_3 = ListItem(List=reverse(sort_list.Keys), Index=0, Wrap=True)
panel_4 = Panel(list_item_3)
panel_5 = Panel("0")
shell_view_karamba3d = ShellViewKaramba3D(Model=model_view_karamba3d.Model, IndexOfLayer=0)  # -> Model, MeshesOfRenderedShells, LegendColors, LegendTags
line_results_on_shells_karamba3d = LineResultsOnShellsKaramba3D(
    AnalyzedModel=analyze_karamba3d.CalculatedModel,
    LCase="A",
    LayerPosition="1",
    ListOfSourcesOfPrincipalStressLinesLinesPoints=populate_geometry,
    SegmentLength_m=0.5,
    DA_deg=5,
    mode="PrincStress")  # -> AnalyzedModel, Lines1, Lines2
galapagos = Galapagos(fitness=number, gene=[number_slider, number_slider_2, number_slider_3, number_slider_4])
line_results_on_shells_karamba3d_2 = LineResultsOnShellsKaramba3D(
    AnalyzedModel=analyze_karamba3d.CalculatedModel,
    LCase="A",
    LayerPosition="-1",
    ListOfSourcesOfPrincipalStressLinesLinesPoints=populate_geometry,
    SegmentLength_m=0.5,
    DA_deg=5,
    mode="PrincStress")  # -> AnalyzedModel, Lines1, Lines2
number = Number(list_item_3)
panel_6 = Panel("OCTOPUS")
