# Grasshopper definition OptimalCrossSection.gh (Grasshopper 1.0.7)
# plug-ins: Karamba3D, Fologram For Grasshopper Utilities

settings_karamba3d = SettingsKaramba3D(menu=[dropdown(0)])  # -> AllSettings, GenericOutput
point = Point(Point(0, 0, 0))
cross_section_range_selector_karamba3d = CrossSectionRangeSelectorKaramba3D(MaximumHeight_cm=-1, MaximumWidth_cm=-1, menu=[dropdown(0), dropdown(0), dropdown(4)])
cross_section_range_selector_karamba3d_2 = CrossSectionRangeSelectorKaramba3D(MaximumHeight_cm=-1, MaximumWidth_cm=-1, menu=[dropdown(0), dropdown(0), dropdown(3)])
cross_section_range_selector_karamba3d_3 = CrossSectionRangeSelectorKaramba3D(MaximumHeight_cm=-1, MaximumWidth_cm=-1, menu=[dropdown(0), dropdown(0), dropdown(2)])
cross_section_karamba3d = CrossSectionKaramba3D(FamilyNameOfCrossSection="DefaultCroSec", Diameter_cm=11.43, WallThickness_cm=0.4, mode="Circular Hollow")
unit_x = UnitX(Factor="8")
move = Move(Geometry=point, Motion=unit_x)  # -> Geometry, Transform
cross_section_karamba3d_2 = CrossSectionKaramba3D(flatten([cross_section_karamba3d, cross_section_range_selector_karamba3d_3, cross_section_range_selector_karamba3d_2, cross_section_range_selector_karamba3d]))
line = Line(StartPoint=point, EndPoint=move.Geometry)
modify_cross_section_karamba3d = ModifyCrossSectionKaramba3D(CroSec=cross_section_karamba3d_2, FamilyNameOfCrossSection="MyCrossSection", mode="Beam")
divide_curve = DivideCurve(Curve=line, Count=10, Kinks=False)  # -> Points, Tangents, Parameters
disassemble_cross_section_karamba3d = DisassembleCrossSectionKaramba3D(CroSec=modify_cross_section_karamba3d)  # -> CrossSection, FamilyNameOfCrossSection, TypeNameOfCrossSection, ElemIdentifiers, Color, Material, LocalEccentricity_cm, Heights_cm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
shatter = Shatter(Curve=line, Parameters=divide_curve.Parameters)
end_points = EndPoints(Curve=line)  # -> Start, End
sort_list = SortList(Keys=disassemble_cross_section_karamba3d.Area_cm2, ValuesA=modify_cross_section_karamba3d)  # -> Keys, ValuesA
panel = Panel("""Left
Right""")
negative = Negative(Value="20")
partition_list = PartitionList(List=shatter, Size="5")  # -> simplify(Chunks)
list_item = ListItem(List=sort_list.ValuesA, Index=0, Wrap=True)
cross_section_karamba3d_3 = CrossSectionKaramba3D(sort_list.ValuesA)
graft_tree = GraftTree(Tree=panel, IncludeEmptyLists=True, IncludeNullItems=True)  # -> simplify(Tree)
unit_z = UnitZ(Factor=negative)
support_karamba3d = SupportKaramba3D(PosInd=[end_points.Start, end_points.End], menu=[buttons(on, on, on, on, on, on)])
line_to_beam_karamba3d = LineToBeamKaramba3D(
    Line=partition_list,
    Identifier=graft_tree,
    CrossSection=list_item,
    New=True,
    Remove=True,
    LimitDistance_m=0.005,
    Bending=True,
    SetBucklingLength=True,
    ToPolylineMaxAngle=0.03,
    ToPolylineTolerance=0.01,
    ToPolylineMaxEdgeLength=0.25)  # -> Element, Points, Info
beam_loads_karamba3d = BeamLoadsKaramba3D(LoadCase="0", ForceVector=unit_z, TPosition=0.5, mode="Concentrated", menu=[buttons(off, on)])
assemble_model_karamba3d = AssembleModelKaramba3D(
    Elem=flatten(line_to_beam_karamba3d.Element),
    Support=support_karamba3d,
    Load=beam_loads_karamba3d,
    LimitDistance_m=0.005)  # -> Model, Info, Mass_kg, CenterOfGravity, LoadCaseNames
panel_2 = Panel(assemble_model_karamba3d.Mass_kg)
optimize_cross_section_karamba3d = OptimizeCrossSectionKaramba3D(
    Model=assemble_model_karamba3d.Model,
    GroupIdentifiers="Left",
    CrossSections=cross_section_karamba3d_3,
    MaximumUtilization="0.8",
    UltimateLimitStateIterations=5,
    DisplacementIterations=5,
    NumberOfSamplePoints=3,
    ElasticDesign=Toggle(False),
    GammaM0=1,
    GammaM1=1.1,
    SwayFrame=True)  # -> ModelWithOptimizedCrossSections, Info, Mass_kg, MaximumDisplacement_cm, ElasticEnergyChange_kNm
model_view_karamba3d = ModelViewKaramba3D(Model=optimize_cross_section_karamba3d.ModelWithOptimizedCrossSections, ResultFactors=1, ResultCase=-1)  # -> Model, DeformedMesh, DeformedAxes, DeformedModel
natural_vibrations_karamba3d = NaturalVibrationsKaramba3D(Model=assemble_model_karamba3d.Model, FromIndex=1, NumberOfModes="6", MaximumNumberOfIterations=30, Epsilon=1e-05)  # -> ModelWithVibrationModesAsLoadCaseResults, NaturalFrequencies_Hz, ModalMass_kg, ParticipationFactorInGlobalXYAndZDirection
beam_view_karamba3d = BeamViewKaramba3D(Model=model_view_karamba3d.Model)  # -> Model, MeshesOfRenderedBeams, DeformedBeamAxes, LegendColors, LegendTags
trigger = Trigger(Interval=1000, TimerInterval=1000, Target=addition)
addition = Addition(B=1)
counter = Counter()
data_recorder = DataRecorder(addition, DataLimit=-10, RecordData=True)
panel_3 = Panel(data_recorder)
mass_addition = MassAddition(Input=panel_3)  # -> Result, PartialResults
sine = Sine(Value=mass_addition.Result)
panel_4 = Panel(mass_addition.Result)
model_view_karamba3d_2 = ModelViewKaramba3D(Model=natural_vibrations_karamba3d.ModelWithVibrationModesAsLoadCaseResults, ResultFactors=sine, ResultCase=-1)  # -> Model, DeformedMesh, DeformedAxes, DeformedModel
beam_view_karamba3d_2 = BeamViewKaramba3D(Model=model_view_karamba3d_2.Model)  # -> Model, MeshesOfRenderedBeams, DeformedBeamAxes, LegendColors, LegendTags
