# Grasshopper definition Parametric tank.gh (Grasshopper 1.0.7)
# plug-ins: Bumblebee

random = Random(Range=Domain(0, 1), Number="26", Seed=2)
partition_list = PartitionList(List=random, Size="2")
fast_write_data = FastWriteData(Worksheet="Formula", Cell="B2", Values=partition_list, Clear=False, Activate=Toggle(True))  # -> Worksheet, Range
sub_ranges = SubRanges(Worksheet=fast_write_data.Worksheet, Range=fast_write_data.Range)  # -> Range, Range_2
tree_statistics = TreeStatistics(Tree=sub_ranges.Range_2)  # -> Paths, Length, Count
range = Range(Domain=Domain(0, 1), Steps=expr("x-1", tree_statistics.Count))
gradient = Gradient(
    LowerLimit=0,
    UpperLimit=1,
    Parameter=range,
    stops=[0: RGBA(237, 26, 58, 0), 0: RGBA(209, 0, 118, 0), 0: RGBA(242, 57, 0, 0), 0: RGB(103, 0, 120), 0.141: RGB(39, 72, 161), 0.283: RGB(1, 192, 229), 0.43: RGB(18, 178, 90), 0.56: RGB(79, 186, 8), 0.698: RGB(220, 237, 32), 0.838: RGB(247, 159, 20), 1: RGB(243, 57, 0)])
graft_tree = GraftTree(Tree=gradient, IncludeEmptyLists=True, IncludeNullItems=True)
range_color = RangeColor(Worksheet=fast_write_data.Worksheet, Range=sub_ranges.Range_2, RangeColor=graft_tree)

# ----
# Input
path = FilePath("C:\GitHub\pellegrino-research-group\Grasshopper-ITEC-engineering\day_8\Excel_Example\Parametric tank inputs.xlsx")

cell_location = CellLocation(Cell="A3")  # -> Column, Row

xl_app = ExcelApplication(Activate=False)
load_workbook = LoadWorkbook(ExcelApplication=xl_app, FilePath=path)

cell_address = CellAddress(Column=cell_location.Column, Row=cell_location.Row, AbsoluteColumn=False, AbsoluteRow=False)

sheet = ValueList({"Input", "Loads"}, selected="Loads")
toggle = BooleanToggle(True)
get_worksheet = GetWorksheet(Workbook=load_workbook, Name=sheet)
live_worksheet = LiveWorksheet(Worksheet=get_worksheet, Activate=toggle)
xl_read = ReadData(Worksheet=live_worksheet, Activate=toggle)  # -> Range, Data
clean = CleanTree(RemoveNulls=True, RemoveInvalid=True, RemoveEmpty=Toggle(True), Tree=xl_read.Data)
flip = FlipMatrix(Data=clean)

# ----
# Roof loads
excel_input = Data(flip)
item = ListItem(List=excel_input, Index=0, Wrap=True)  # -> flatten(Item)
parameter = Text("Density, liquid")
mindex = MemberIndex(Set=item, Member="Parameter")  # -> Index, Count
mindex_2 = MemberIndex(Set=item, Member="Value")  # -> Index, Count
mindex_3 = MemberIndex(Set=item, Member="Unit")  # -> Index, Count
mindex_4 = MemberIndex(Set=item, Member="Comment")  # -> Index, Count
branch = TreeBranch(Tree=excel_input, Path=mindex.Index, MaintainPaths=True)
branch_2 = TreeBranch(Tree=excel_input, Path=mindex_2.Index, MaintainPaths=True)
branch_3 = TreeBranch(Tree=excel_input, Path=mindex_3.Index, MaintainPaths=True)
branch_4 = TreeBranch(Tree=excel_input, Path=mindex_4.Index, MaintainPaths=True)
txt = Text(branch)
keysearch = KeyValueSearch(Keys=txt, Values=branch_2, Search=parameter)
keysearch_2 = KeyValueSearch(Keys=txt, Values=branch_3, Search=parameter)
keysearch_3 = KeyValueSearch(Keys=txt, Values=branch_4, Search=parameter)
value = Text(keysearch)
unit = Text(keysearch_2)
# Correcting the index
# Gas pressure
# Soil
# Live load around tank
# Ground water
comment = Text(keysearch_3)

panel = Panel(value)
