# Grasshopper definition Parametric tank_LIVE.gh (Grasshopper 1.0.7)
# plug-ins: Bumblebee

excel_application = ExcelApplication(Activate=Toggle(True))
file_path = FilePath("C:\GitHub\pellegrino-research-group\Grasshopper-ITEC-engineering\day_8\Excel_Example\Parametric tank inputs.xlsx")
load_workbook = LoadWorkbook(ExcelApplication=excel_application, FilePath=file_path)
worksheet_name = Panel("Input")
get_worksheet = GetWorksheet(Workbook=load_workbook, Name=worksheet_name)
boolean_toggle = BooleanToggle(True)
live_worksheet = LiveWorksheet(Worksheet=get_worksheet, Activate=boolean_toggle)
panel = Panel("""a
b
c
d
e""")
read_data = ReadData(Worksheet=live_worksheet, Activate=boolean_toggle)  # -> Range, Data
member_index = MemberIndex(Set=panel, Member="c")  # -> Index, Count
panel_2 = Panel(member_index.Index)
flip_matrix = FlipMatrix(Data=read_data.Data)
param_viewer = ParamViewer(flip_matrix)
read_data_2 = ReadData(Worksheet=live_worksheet, Activate=boolean_toggle)  # -> Range, Data

panel_3 = Panel(read_data.Data)
tree_item = TreeItem(Tree=read_data.Data, Path="9", Index="1", Wrap=True)
tree_item_2 = TreeItem(Tree=read_data.Data, Path="13", Index="1", Wrap=True)
tree_branch = TreeBranch(Tree=read_data.Data, Path="9", MaintainPaths=True)
panel_4 = Panel(tree_branch)
water = Panel(tree_item_2)
external_soil = Panel(tree_item)

panel_5 = Panel(flip_matrix)
flip_matrix_2 = FlipMatrix(Data=read_data_2.Data)
get_worksheet_2 = GetWorksheet(Workbook=load_workbook, Name="Formula")
list_item = ListItem(List=flip_matrix_2, Index=0, Wrap=True)  # -> flatten(Item)
column = Panel("Value")
member_index_2 = MemberIndex(Set=list_item, Member=column)  # -> Index, Count
member_index_3 = MemberIndex(Set=list_item, Member="Parameter")  # -> Index, Count
random = Random(Range=Domain(0, 1), Number="26", Seed=2)
tree_branch_2 = TreeBranch(Tree=flip_matrix_2, Path=member_index_3.Index, MaintainPaths=True)
tree_branch_3 = TreeBranch(Tree=flip_matrix_2, Path=member_index_2.Index, MaintainPaths=True)
partition_list = PartitionList(List=random, Size="2")
value_to_return = Panel("Concrete quality")
key_value_search = KeyValueSearch(Keys=tree_branch_2, Values=tree_branch_3, Search=value_to_return)
fast_write_data = FastWriteData(Worksheet=get_worksheet_2, Cell="B2", Values=partition_list, Clear=False, Activate=Toggle(True))  # -> Worksheet, Range
panel_6 = Panel(key_value_search)

colour_swatch = ColourSwatch(SwatchColor=RGB(133, 0, 0))
read_data_3 = ReadData(Worksheet=get_worksheet_2, Range="B7:N7", Activate=Toggle(True))  # -> Range, Data
sub_ranges = SubRanges(Worksheet=get_worksheet_2, Range="B7:N7")  # -> Range, Range_2
smaller_than = SmallerThan(FirstNumber=read_data_3.Data, SecondNumber=Slider(0.6, range=0..1))  # -> SmallerThan, OrEqualTo
merge = Merge(Data1=ColourSwatch(SwatchColor=RGB(255, 0, 0)), Data2=ColourSwatch(SwatchColor=RGB(0, 168, 36)))
integer = Integer(smaller_than.SmallerThan)
panel_7 = Panel(integer)
list_item_2 = ListItem(List=merge, Index=integer, Wrap=True)
graft_tree = GraftTree(Tree=list_item_2, IncludeEmptyLists=True, IncludeNullItems=True)  # -> simplify(Tree)
range_font = RangeFont(Worksheet=get_worksheet_2, Range=sub_ranges.Range_2, Color=graft_tree, Size="12", IsBold=Toggle(True))

sub_ranges_2 = SubRanges(Worksheet=fast_write_data.Worksheet, Range="B2:N3")  # -> Range, Range_2
read_data_4 = ReadData(Worksheet=fast_write_data.Worksheet, Range=sub_ranges_2.Range, Activate=Toggle(True))  # -> Range, Data
flip_matrix_3 = FlipMatrix(Data=read_data_4.Data)
gradient = Gradient(LowerLimit=0, UpperLimit=1, Parameter=flip_matrix_3, stops=[0: RGB(0, 128, 0), 0.8: RGB(0, 128, 0), 1: RGB(255, 0, 0)])
range_color = RangeColor(Worksheet=fast_write_data.Worksheet, Range=sub_ranges_2.Range_2, RangeColor=gradient)
