# Grasshopper definition Example_Live.gh (Grasshopper 1.0.7)

# ---- group: item access
panel = Panel("""3
5""")
panel_2 = Panel("""4
6""")
panel_3 = Panel("""1
3""")
ghpython_script = GhPythonScript(x=panel_3, y=panel, z=panel_2)  # -> out, a
# ---------- ghpython_script: Python ----------
__author__ = "Marco"
__version__ = "2023.05.11"

import rhinoscriptsyntax as rs

a = "x,y,z\n{0},{1},{2}".format(x,y,z)
# ---------- end ghpython_script ----------
panel_4 = Panel(ghpython_script.a)

# ---- group: list access
panel_5 = Panel("""3
5""")
panel_6 = Panel("""1
3""")
panel_7 = Panel("""4
6""")
ghpython_script_2 = GhPythonScript(x=panel_6, y=panel_5, z=panel_7)  # -> out, a, multi_text; inputs x: list, y: list, z: list
# ---------- ghpython_script_2: Python ----------
__author__ = "Marco"
__version__ = "2023.05.11"

import rhinoscriptsyntax as rs

a = "x,y,z"

multi_text = []
multi_text.append(a)

tracker = 0
for i in x:
    temp_x = x[tracker]
    temp_y = y[tracker]
    temp_z = z[tracker]
    
    text = "{0},{1},{2}".format(temp_x, temp_y, temp_z)
    
    multi_text.append(text)
    
    print(text)
    tracker = tracker + 1
# ---------- end ghpython_script_2 ----------
panel_8 = Panel(ghpython_script_2.a)

# ----
panel_9 = Panel("""STEEL
CONCRETE
STEEL
STEEL""")
panel_10 = Panel("""0
1
2
3""")
panel_11 = Panel("""x,y,z
1,3,4
3,5,6""")
ghpython_script_3 = GhPythonScript(x="10", y="22", factor=Slider(0.3, range=0..1))  # -> out, average, sum
# ---------- ghpython_script_3: Python ----------
# Commento a linea


__author__ = "Marco"
__version__ = "2023.05.11"

import rhinoscriptsyntax as rs

average = (x + y) * factor
sum = x + y

print average
print sum
# ---------- end ghpython_script_3 ----------
ghpython_script_4 = GhPythonScript(index=panel_10, material=panel_9)  # -> out, a
# ---------- ghpython_script_4: Python ----------
__author__ = "Marco"
__version__ = "2023.05.11"

import rhinoscriptsyntax as rs

a = "BEAM {0} {1}".format(index, material)
# ---------- end ghpython_script_4 ----------
ghpython_script_5 = GhPythonScript()  # -> out, a
# ---------- ghpython_script_5: Python ----------
__author__ = "Marco"
__version__ = "2023.05.11"

import rhinoscriptsyntax as rs
import math

a = math.pow(3,5)
# ---------- end ghpython_script_5 ----------
ghpython_script_6 = GhPythonScript(x=Slider(6.61, range=0..10), y=Slider(10, range=0..10), z=Slider(0.89, range=0..10), r="2")  # -> out, a, b
# ---------- ghpython_script_6: Python ----------
__author__ = "Marco"
__version__ = "2023.05.11"

import Rhino.Geometry as rg

a = rg.Point3d(x,y,z)

b = rg.Circle(a, r)
# ---------- end ghpython_script_6 ----------
panel_12 = Panel(ghpython_script_3.average)
panel_13 = Panel(ghpython_script_3.out)
panel_14 = Panel(ghpython_script_3.sum)
panel_15 = Panel(ghpython_script_2.multi_text)
panel_16 = Panel(ghpython_script_5.a)
panel_17 = Panel(ghpython_script_4.a)
