# Grasshopper definition 0_Create.gh (Grasshopper 1.0.7)
# plug-ins: Rhino.Inside for Autodesk Revit

unit_x = UnitX(Factor=1)
basic_wall = ElementTypePicker({"Basic Wall : Wall 1": "6fd16986-88f8-48ca-934f-0df0db84b791:7487a6f9-f026-4d8b-9c25-00897bd0c023-000006f6"}, selected="Basic Wall : Wall 1")
point = Point(Point(0, 0, 0))
line_sdl = LineSDL(Start=point, Direction=unit_x, Length="5000")
levels_picker = LevelsPicker()
wall_location_line = WallLocationLine({"Wall Centerline": 0, "Core Centerline": 1, "Finish (Exterior Face)": 2, "Finish (Interior Face)": 3, "Core (Exterior Face)": 4, "Core (Interior Face)": 5}, selected="Finish (Interior Face)")
curve = Curve(line_sdl)
add_wall_curve = AddWallCurve(Curve=curve, Type=basic_wall, Height="2000", LocationLine=wall_location_line, TrackingMode=2)
element_type = ElementType()  # -> Element, Type
inspect_element = InspectElement(Element=add_wall_curve)  # -> ConstraintsRelatedToMass, ConstraintsRoomBounding, ConstraintsBaseConstraint, ConstraintsBaseOffset, ConstraintsBaseExtensionDistance, ConstraintsBaseIsAttached, ConstraintsCrossSection, ConstraintsTopConstraint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
element_geometry = ElementGeometry(Elements=add_wall_curve)
element_parameter = ElementParameter(Element=add_wall_curve, Parameter="Structural", Value="yes", FailureProcessingMode=1)  # -> Element, Value

count = Count(10)
series = Series(Start=0, Step="1000", Count=count)
construct_point = ConstructPoint(XCoordinate=series, YCoordinate=0, ZCoordinate=0)
unit_y = UnitY(Factor=1)
vector_xyz = VectorXYZ(XComponent="1", YComponent="1", ZComponent=0)  # -> Vector, Length
series_2 = Series(Start=0, Step=1, Count=count)
line_sdl_2 = LineSDL(Start=construct_point, Direction=vector_xyz.Vector, Length="10000")
add_grid = AddGrid(Curve=line_sdl_2, Name=series_2, Type=<elementtype referenced from the Revit model>, TrackingMode=2)
element_geometry_2 = ElementGeometry(Elements=add_grid)

series_3 = Series(Start=0, Step="3000", Count=10)
concatenate = Concatenate(FragmentA="Level_", FragmentB=series_3)
project_elevation = ProjectElevation(Offset=series_3)
add_level = AddLevel(Elevation=project_elevation, Name=concatenate, Type=<elementtype referenced from the Revit model>, TrackingMode=2)

directshape_categories = DirectShapeCategories()
directshape_categories_2 = DirectShapeCategories("autodesk.revit.category.local:structuralFramingSystem-1.0.0", SearchPattern="beam")  # disabled
center_box = CenterBox(Base=PlaneXY(0, 0, 0), X=1, Y=1, Z=1)  # disabled
query_types = QueryTypes(Kind=3)  # disabled
panel = Panel("-1")  # disabled
add_directshape = AddDirectShape(TrackingMode=2)  # disabled
add_geometry_directshape = AddGeometryDirectShape(Category=directshape_categories_2, Geometry=center_box, TrackingMode=2)  # disabled
add_directshape_type = AddDirectShapeType(TrackingMode=2)  # disabled
active_document = ActiveDocument()  # disabled
list_item = ListItem(List=query_types, Index=panel, Wrap=True)  # disabled
built_in_categories = BuiltInCategories("autodesk.revit.category.local:beamAnalytical-1.0.0", SearchPattern="beams")  # disabled
category_types = CategoryTypes({"Model": 1, "Annotation": 2, "Internal": 4, "Analytical": 5}, selected="Model")  # disabled
built_in_categories_2 = BuiltInCategories("autodesk.revit.category.local:floors-1.0.0", SearchPattern="floors")  # disabled
add_directshape_2 = AddDirectShape(TrackingMode=2)  # disabled
family_types = FamilyTypes()  # disabled
add_directshape_type_2 = AddDirectShapeType(TrackingMode=2)  # disabled
component_families_picker = ComponentFamiliesPicker(<component families picker referenced from the Revit model>, SearchPattern="FON-CA")  # disabled
panel_2 = Panel("0,0,0")  # disabled
add_component_location = AddComponentLocation(Location=panel_2, Type=list_item, TrackingMode=2)  # disabled
element_type_picker = ElementTypePicker(
    built_in_categories_2,
    {"Floor : Floor-Grnd-Bearing_65Scr-90Ins-125Conc-50SBld-150Hcore": "d7b6c3e6-85b5-4886-a113-e140edfd403a:d8a078da-da75-47f7-a533-420fe7adac36-0003525f", "Floor : Floor-Grnd-Susp_65Scr-80Ins-100Blk-75PC": "d7b6c3e6-85b5-4886-a113-e140edfd403a:d8a078da-da75-47f7-a533-420fe7adac36-0003525e", "Floor : Floor-Upper_160mmConc-CorusComFlor51": "d7b6c3e6-85b5-4886-a113-e140edfd403a:d8a078da-da75-47f7-a533-420fe7adac36-00035262", "Floor : Floor_Timber_22Cbd-225Joist": "d7b6c3e6-85b5-4886-a113-e140edfd403a:d8a078da-da75-47f7-a533-420fe7adac36-0003525c"}, selected="Floor : Floor-Grnd-Bearing_65Scr-90Ins-125Conc-50SBld-150Hcore")  # disabled
category_filter = CategoryFilter(Categories=built_in_categories, Inverted=False)  # disabled
category_identity = CategoryIdentity(Category=built_in_categories)  # -> Type, Name, IsSubcategory; disabled
category_filter_2 = CategoryFilter(Categories=built_in_categories_2, Inverted=False)  # disabled
element_parameter_2 = ElementParameter(Element=add_component_location)  # -> Element, Value; disabled
query_elements = QueryElements(Filter=category_filter, Limit=100)  # -> Elements, Count; disabled
query_elements_2 = QueryElements(Filter=category_filter_2, Limit=100)  # -> Elements, Count; disabled
file_path = FilePath("C:\GitHub\pellegrino-research-group\Grasshopper-ITEC-engineering\day_9\File Revit 2021\Famiglie\FON-CA-O-Micropalo.rfa")  # disabled
family_identity = FamilyIdentity()  # -> Category, Name; disabled
panel_3 = Panel(query_elements.Elements)  # disabled
query_families = QueryFamilies(Kind=3)  # disabled
family_types_2 = FamilyTypes()  # disabled
panel_4 = Panel(query_elements_2.Elements)  # disabled
load_component_family = LoadComponentFamily(Path=file_path, Overwrite=False)  # disabled
save_component_family = SaveComponentFamily(Overwrite=False, Compact=False, Backups=-1)  # disabled
family_types_3 = FamilyTypes(Family=load_component_family)  # disabled
point_2 = Point(Point(10, 10, 10))  # disabled
new_component_family = NewComponentFamily(Overwrite=False)  # disabled
add_component_location_2 = AddComponentLocation(Location=point_2, Type=family_types_3, TrackingMode=2)  # disabled
