# Grasshopper definition 1_Reference.gh (Grasshopper 1.0.7)
# plug-ins: Rhino.Inside for Autodesk Revit, BH.UI.Grasshopper

graphical_element = GraphicalElement(<floor referenced from the Revit model>)  # disabled
element_geometry = ElementGeometry(Elements=graphical_element)  # disabled
element_type = ElementType(Element=graphical_element, Type=<hostobjecttype referenced from the Revit model>)  # -> Element, Type; disabled
deconstruct_brep = DeconstructBrep(Brep=element_geometry)  # -> Faces, Edges, Vertices; disabled
panel = Panel("2")  # disabled
panel_2 = Panel("0")  # disabled
list_item = ListItem(List=deconstruct_brep.Edges, Index=panel, Wrap=True)  # disabled
list_item_2 = ListItem(List=deconstruct_brep.Edges, Index=panel_2, Wrap=True)  # disabled
divide_curve = DivideCurve(Curve=list_item_2, Count=10, Kinks=False)  # -> Points, Tangents, Parameters; disabled
divide_curve_2 = DivideCurve(Curve=list_item, Count=10, Kinks=False)  # -> Points, Tangents, Parameters; disabled
reverse_list = ReverseList(List=divide_curve_2.Points)  # disabled
ub_universal_beams = ElementTypePicker({"UB-Universal Beams : UB305x165x40": "d7b6c3e6-85b5-4886-a113-e140edfd403a:51d13581-a673-410b-a4b1-7d120a2adc60-0003ded8"}, selected="UB-Universal Beams : UB305x165x40")  # disabled
line = Line(StartPoint=divide_curve.Points, EndPoint=reverse_list)  # disabled
add_structural_beam = AddStructuralBeam(Curve=line, Type=ub_universal_beams, TrackingMode=2)  # disabled
list_item_3 = ListItem(List=add_structural_beam, Index=0, Wrap=True)  # disabled
number_slider = Slider(0, range=0..3)  # disabled
panel_3 = Panel("z Justification")  # disabled
query_element_parameters = QueryElementParameters(Element=list_item_3)  # disabled
query_element_parameters_2 = QueryElementParameters(Element=list_item_3)  # disabled
inspect_element = InspectElement(Element=add_structural_beam)  # -> ConstraintsReferenceLevel, ConstraintsStartLevelOffset, ConstraintsEndLevelOffset, ConstraintsCrossSectionRotation, DimensionsVolume, DimensionsLength, DimensionsElevationAtBottom, DimensionsElevationAtTop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; disabled
inspect_element_2 = InspectElement()  # disabled
element_parameter = ElementParameter(Element=add_structural_beam, Parameter=panel_3, Value=number_slider)  # -> Element, Value; disabled
explode = Explode(Object=query_element_parameters_2, Component="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")  # disabled
