# Grasshopper definition 2_CreateFamily.gh (Grasshopper 1.0.7)
# plug-ins: Rhino.Inside for Autodesk Revit, Human

rectangle = Rectangle(Plane=PlaneXY(0, 0, 0), XSize=Domain(-1, 1), YSize=Domain(-2, 2), Radius=0)  # -> Rectangle, Length
item_selector = ItemSelector()
offset_curve = OffsetCurve(Curve=rectangle.Rectangle, Distance=1, Corners=1)
curve = Curve(rectangle.Rectangle)
boundary_surfaces = BoundarySurfaces(Edges=flatten(curve))
category = Category(<category referenced from the Revit model>)
boundary_surfaces_2 = BoundarySurfaces(Edges=flatten([curve, offset_curve]))
unit_z = UnitZ(Factor="0.50")
category_subcategories = CategorySubCategories(Category=category)
category_subcategories_2 = CategorySubCategories(Category=category)
extrude = Extrude(Base=boundary_surfaces, Direction=unit_z)
unit_z_2 = UnitZ(Factor=1)
value_picker = ValuePicker(category_subcategories_2)
value_picker_2 = ValuePicker(category_subcategories)
query_materials = QueryMaterials()
query_materials_2 = QueryMaterials()
extrude_2 = Extrude(Base=boundary_surfaces_2, Direction=unit_z_2)
cap_holes = CapHoles(Brep=extrude)
list_item = ListItem(List=query_materials, Index="3", Wrap=True)
list_item_2 = ListItem(List=query_materials_2, Index="3", Wrap=True)
cap_holes_2 = CapHoles(Brep=extrude_2)
component_family_form = ComponentFamilyForm(Brep=cap_holes, Subcategory=value_picker, Material=list_item_2)
component_family_form_2 = ComponentFamilyForm(Brep=cap_holes_2, Subcategory=value_picker_2, Material=list_item)
panel = Panel("C:\GitHub\pellegrino-research-group\Grasshopper-ITEC-engineering\day_9\File Revit 2021\Famiglie\generated\")
file_path = FilePath("C:\GitHub\pellegrino-research-group\Grasshopper-ITEC-engineering\day_9\File Revit 2021\Famiglie\FON-CA-O-Micropalo.rfa")
entwine = Entwine(Branch00=[component_family_form_2, component_family_form], FlattenInputs=True)
family = Family(<family referenced from the Revit model>)
load_component_family = LoadComponentFamily(Path=file_path, Overwrite=False)
family_identity = FamilyIdentity(Family=family)  # -> Category, Name
family_types = FamilyTypes(Family=family)
repeat_data = RepeatData(Data=entwine, Length="20")
query_elements = QueryElements(Limit=100)  # -> Elements, Count
graft_tree = GraftTree(Tree=repeat_data, IncludeEmptyLists=True, IncludeNullItems=True)
tree_statistics = TreeStatistics(Tree=graft_tree)  # -> Paths, Length, Count
concatenate = Concatenate(FragmentA=panel, FragmentB="my template.rft")
panel_2 = Panel("0200-400")
series = Series(Start=0, Step=1, Count=tree_statistics.Count)
graft_tree_2 = GraftTree(Tree=series, IncludeEmptyLists=True, IncludeNullItems=True)
new_component_family = NewComponentFamily(Template="Metric Window.rft", Overwrite=Toggle(False), Name=graft_tree_2, Category=category, Geometry=graft_tree)  # disabled
panel_3 = Panel("C:\GitHub\pellegrino-research-group\Grasshopper-ITEC-engineering\day_9\File Revit 2021\Famiglie\generated\")  # disabled
concatenate_2 = Concatenate(FragmentA=panel_3, FragmentB=graft_tree_2)  # -> simplify(Result); disabled
save_component_family = SaveComponentFamily(Family=new_component_family, Path=concatenate_2, Overwrite=False, Compact=False, Backups=-1)  # disabled
panel_4 = Panel(save_component_family)  # disabled
