# Grasshopper definition Prova per tratto aggiornato.gh (Grasshopper 1.0.7)
# plug-ins: Rhino.Inside for Autodesk Revit

query_types = QueryTypes(Kind=3)
list_item = ListItem(List=query_types, Index="-1", Wrap=True)
add_component_location = AddComponentLocation(Location="0,0,0", Type=list_item, TrackingMode=2)

file_path = FilePath("C:\GitHub\pellegrino-research-group\Grasshopper-ITEC-engineering\day_9\File Revit 2021\Famiglie\FON-CA-O-Micropalo.rfa")
load_component_family = LoadComponentFamily(Path=file_path, Overwrite=False)
family_types = FamilyTypes(Family=load_component_family)
point = Point(Point(10, 10, 10))
add_component_location_2 = AddComponentLocation(Location=point, Type=family_types, TrackingMode=2)

built_in_categories = BuiltInCategories("autodesk.revit.category.local:beamAnalytical-1.0.0", SearchPattern="beams")
category_filter = CategoryFilter(Categories=built_in_categories, Inverted=False)
category_identity = CategoryIdentity(Category=built_in_categories)  # -> Type, Name, IsSubcategory
query_elements = QueryElements(Filter=category_filter, Limit=100)  # -> Elements, Count
panel = Panel(query_elements.Elements)
element_geometry = ElementGeometry(Elements=query_elements.Elements)

built_in_categories_2 = BuiltInCategories("autodesk.revit.category.local:floors-1.0.0", SearchPattern="floors")
element_type_picker = ElementTypePicker(
    built_in_categories_2,
    {"Floor : Alveo": "8666a9c8-a2bc-4af9-ab9f-d0a63f9f836a:fc9906c1-1c40-4fb8-ba7d-bb652216d70a-0006ccfb", "Floor : Floor-Grnd-Bearing_65Scr-90Ins-125Conc-50SBld-150Hcore": "8666a9c8-a2bc-4af9-ab9f-d0a63f9f836a:b5e07899-7447-495b-8773-61c10f6f6f8a-0000b175", "Floor : Floor-Grnd-Susp_65Scr-80Ins-100Blk-75PC": "8666a9c8-a2bc-4af9-ab9f-d0a63f9f836a:b5e07899-7447-495b-8773-61c10f6f6f8a-0000b174", "Floor : Floor-Upper_160mmConc-CorusComFlor51": "8666a9c8-a2bc-4af9-ab9f-d0a63f9f836a:f8299cc5-025e-49c2-8089-477d4f73066e-0002d5fc", "Floor : Floor_Timber_22Cbd-225Joist": "8666a9c8-a2bc-4af9-ab9f-d0a63f9f836a:b5e07899-7447-495b-8773-61c10f6f6f8a-0000b156"}, selected="Floor : Alveo")
category_filter_2 = CategoryFilter(Categories=built_in_categories_2, Inverted=False)
query_elements_2 = QueryElements(Filter=category_filter_2, Limit=100)  # -> Elements, Count
panel_2 = Panel(query_elements_2.Elements)
element_geometry_2 = ElementGeometry(Elements=query_elements_2.Elements)
