# Grasshopper definition 0_lice_create.gh (Grasshopper 1.0.7)
# plug-ins: Rhino.Inside for Autodesk Revit

basic_wall = ElementTypePicker({"Basic Wall : Wall 1": "3f7ff0d9-ae47-4b27-8515-5972a4736734:7e1ab35a-4dec-4654-b2fb-1cc52f3a08f7-000006f6"}, selected="Basic Wall : Wall 1")
wall_location_line = WallLocationLine({"Wall Centerline": 0, "Core Centerline": 1, "Finish (Exterior Face)": 2, "Finish (Interior Face)": 3, "Core (Exterior Face)": 4, "Core (Interior Face)": 5}, selected="Core (Exterior Face)")
curve = Curve(<curve referenced from the Rhino model>)
explode = Explode(Curve=curve, Recursive=True)  # -> Segments, Vertices
series = Series(Start=0, Step="3000", Count="15")
add_wall_curve = AddWallCurve(
    Curve=explode.Segments,
    Type=basic_wall,
    Height=Slider(3560, range=3000..5000),
    LocationLine=wall_location_line,
    TrackingMode=2)
curve_element = CurveElement(<curve element referenced from the Revit model>)
base_point = BasePoint(<internalorigin referenced from the Revit model>)
curve_2 = Curve(curve_element)
project_elevation = ProjectElevation(BasePoint=base_point, Offset=series)
divide_curve = DivideCurve(Curve=curve_2, Count=10, Kinks=False)  # -> Points, Tangents, Parameters
concatenate = Concatenate(FragmentA="Grid_", FragmentB=series)
element = Element(add_wall_curve)
element_parameter = ElementParameter(Element=element, Parameter="Structural", Value=Toggle(True))  # -> Element, Value
perp_frame = PerpFrame(Curve=curve_2, Parameter=divide_curve.Parameters)
element_geometry = ElementGeometry(Elements=element)  # -> flatten(Geometry)
add_level = AddLevel(Elevation=project_elevation, Name=concatenate, TrackingMode=2)
element_materials = ElementMaterials(Element=element)  # -> Materials, Paint
deconstruct_plane = DeconstructPlane(Plane=perp_frame)  # -> Origin, XAxis, YAxis, ZAxis
element_geometry_2 = ElementGeometry(Elements=add_level)
extract_material_s_assets = ExtractMaterialsAssets(Material=element_materials.Materials)  # -> AppearanceAsset, PhysicalAsset, ThermalAsset
reverse = Reverse(Vector=deconstruct_plane.YAxis)
deconstruct_brep = DeconstructBrep(Brep=element_geometry)  # -> Faces, Edges, Vertices
element_parameter_2 = ElementParameter(Element=element_parameter.Element, Parameter="Structural Usage", Value="2")  # -> Element, Value
panel = Panel(element_geometry_2)
line_sdl = LineSDL(Start=deconstruct_plane.Origin, Direction=reverse, Length="50000")
list_length = ListLength(List=line_sdl)
inspect_element = InspectElement(Element=element_parameter_2.Element)  # -> ConstraintsRelatedToMass, ConstraintsRoomBounding, ConstraintsBaseConstraint, ConstraintsBaseOffset, ConstraintsBaseExtensionDistance, ConstraintsBaseIsAttached, ConstraintsCrossSection, ConstraintsTopConstraint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
series_2 = Series(Start=0, Step=1, Count=list_length)
add_grid = AddGrid(Curve=line_sdl, Name=series_2, TrackingMode=2)
element_geometry_3 = ElementGeometry(Elements=add_grid)
