# Grasshopper definition 1_reference.gh (Grasshopper 1.0.7)
# plug-ins: Rhino.Inside for Autodesk Revit

graphical_element = GraphicalElement([<wall referenced from the Revit model> x2])
element_geometry = ElementGeometry(Elements=graphical_element)
panel = Panel(element_geometry)
deconstruct_brep = DeconstructBrep(Brep=element_geometry)  # -> Faces, Edges, Vertices
directshape_categories = DirectShapeCategories("autodesk.revit.category.family:genericModel-1.0.0", SearchPattern="generic")
sphere = Sphere(Base=PlaneXY(0, 0, 0), Radius="1000")
domain_box = DomainBox(Base=PlaneXY(0, 0, 0), X="1000", Y="1000", Z="1000")
list_item = ListItem(List=deconstruct_brep.Edges, Index=Slider(2, range=0..11), Wrap=True)
add_geometry_directshape = AddGeometryDirectShape(Category=directshape_categories, Geometry=sphere, TrackingMode=2)
divide_curve = DivideCurve(Curve=list_item, Count=10, Kinks=False)  # -> Points, Tangents, Parameters
flip_matrix = FlipMatrix(Data=divide_curve.Points)  # -> simplify(Data)
ipe_beams = ElementTypePicker({"IPE-Beams : IPE100": "6fd16986-88f8-48ca-934f-0df0db84b791:d860b571-2420-4fd2-aaf4-9c9b0e19f760-00001347", "IPE-Beams : IPE120": "6fd16986-88f8-48ca-934f-0df0db84b791:d860b571-2420-4fd2-aaf4-9c9b0e19f760-00001349", "IPE-Beams : IPE140": "6fd16986-88f8-48ca-934f-0df0db84b791:d860b571-2420-4fd2-aaf4-9c9b0e19f760-0000134b", "IPE-Beams : IPE160": "6fd16986-88f8-48ca-934f-0df0db84b791:d860b571-2420-4fd2-aaf4-9c9b0e19f760-0000134d", "IPE-Beams : IPE80": "6fd16986-88f8-48ca-934f-0df0db84b791:d860b571-2420-4fd2-aaf4-9c9b0e19f760-00001345"}, selected="IPE-Beams : IPE100")
polyline = PolyLine(Vertices=flip_matrix, Closed=False)
add_structural_beam = AddStructuralBeam(Curve=polyline, Type=ipe_beams, TrackingMode=2)
element_parameter = ElementParameter(Element=add_structural_beam, Parameter="z Justification", Value=Slider(3, range=0..3))  # -> Element, Value
query_element_parameters = QueryElementParameters(Element=element_parameter.Element)
