# Grasshopper definition create_family.gh (Grasshopper 1.0.7)
# plug-ins: Rhino.Inside for Autodesk Revit

panel = Panel("""2000
2500
3000""")
category = Category(<category referenced from the Revit model>)
graft_tree = GraftTree(Tree=panel, IncludeEmptyLists=True, IncludeNullItems=True)
absolute = Absolute(Value="-50")
rectangle = Rectangle(Plane=PlaneXY(0, 0, 0), XSize="500", YSize=graft_tree, Radius=0)  # -> simplify(Rectangle), Length
category_subcategories = CategorySubCategories(Category=category)
offset_curve = OffsetCurve(Curve=rectangle.Rectangle, Distance="-50", Corners=1)  # -> simplify(Curve)
category_subcategories_2 = CategorySubCategories(Category=category)
merge = Merge(Data1=rectangle.Rectangle, Data2=offset_curve)
value_picker = ValuePicker(category_subcategories)
boundary_surfaces = BoundarySurfaces(Edges=offset_curve)
convert_material = ConvertMaterial(Shader=ColourSwatch(SwatchColor=RGB(201, 0, 0)), TrackingMode=2)
value_picker_2 = ValuePicker(category_subcategories_2)
unit_z = UnitZ(Factor="5")
convert_material_2 = ConvertMaterial(Shader=ColourSwatch(SwatchColor=RGB(255, 255, 255)), TrackingMode=2)
boundary_surfaces_2 = BoundarySurfaces(Edges=merge)
unit_z_2 = UnitZ(Factor="25")
extrude = Extrude(Base=boundary_surfaces, Direction=unit_z)
extrude_2 = Extrude(Base=boundary_surfaces_2, Direction=unit_z_2)
component_family_form = ComponentFamilyForm(Brep=extrude_2, Subcategory=value_picker_2, Material=convert_material_2)  # -> simplify(Brep)
component_family_form_2 = ComponentFamilyForm(Brep=extrude, Subcategory=value_picker, Material=convert_material)  # -> simplify(Brep)
format = Format(Format="base {0} altezza {1} spessore {2}", Culture=127, Data0="500", Data1=simplify(graft_tree), Data2=absolute)
merge_2 = Merge(Data1=component_family_form, Data2=component_family_form_2)
panel_2 = Panel("C:\GitHub\pellegrino-research-group\Grasshopper-ITEC-engineering\day_9\File Revit 2021\Famiglie\generated\")
new_component_family = NewComponentFamily(Overwrite=False, Name=format, Category=category, Geometry=merge_2)
file_path = FilePath()
concatenate = Concatenate(FragmentA=panel_2, FragmentB=format)
save_component_family = SaveComponentFamily(Family=new_component_family, Path=concatenate, Overwrite=False, Compact=False, Backups=-1)
